# Grasshopper definition beam_endcut.gh (Grasshopper 1.0.7)

vector_xyz = VectorXYZ(XComponent=Slider(-10, range=-10..10), YComponent=Slider(8, range=-10..10), ZComponent=Slider(8, range=-10..10))  # -> Vector, Length
construct_point = ConstructPoint(XCoordinate=Slider(100, range=0..100), YCoordinate=Slider(0, range=0..100), ZCoordinate=Slider(0, range=0..100))
plane_normal = PlaneNormal(Origin=construct_point, ZAxis=vector_xyz.Vector)

# ----
# Reload Python Modules (if Module Code is Changed)
python_module_to_reload = Panel("""compas
compas_fab
roslibpy
integral_timber_joints""")
# Development Tools
reload = Button()
py = PythonScript(reload_module_button=reload, module_names=python_module_to_reload)  # inputs module_names: list
# ---------- py: Python ----------
import compas_ghpython
from compas_ghpython import unload_modules
if reload_module_button:
    for module in module_names:
        unload_modules(module)
# ---------- end py ----------

# ----
# Check Path and Environment
compas_version = GhPythonScript()  # -> out, compas_version, compas_fab_version, compas_path, compas_fab_path, compas_env_name, python_directory
# ---------- compas_version: Python ----------
__author__ = "leungp"
__version__ = "2020.04.20"

import rhinoscriptsyntax as rs
import compas
import compas_fab
compas_version  = compas.__version__
compas_fab_version = compas_fab.__version__
import os
compas_path = os.path.abspath(compas.__file__)
compas_fab_path = os.path.abspath(compas_fab.__file__)

import compas_bootstrapper
compas_env_name = compas_bootstrapper.ENVIRONMENT_NAME
python_directory = compas_bootstrapper.PYTHON_DIRECTORY
# ---------- end compas_version ----------
compas_environment_name = Panel(compas_version.compas_env_name)
compas_version_2 = Panel(compas_version.compas_version)
compas_fab_version = Panel(compas_version.compas_fab_version)
compas_path = Panel(compas_version.compas_path)
compas_fab_path = Panel(compas_version.compas_fab_path)
python_directory = Panel(compas_version.python_directory)

xy = XYPlane(Origin=Point(0, 0, 0))
beam = GhPythonScript(
    plane=xy,
    length=Slider(1000, range=0..1000),
    width=Slider(100, range=0..200),
    height=Slider(111, range=0..200),
    name="b1")  # -> out, beam, assembly; inputs plane: Plane
# ---------- beam: Python ----------
from compas_rhino.geometry import RhinoMesh, RhinoPlane

from integral_timber_joints.geometry import Beam
from integral_timber_joints.assembly import Assembly

frame = RhinoPlane.from_geometry(plane).to_compas()

beam = Beam(frame, length, width, height, name)

assembly = Assembly()
assembly.add_beam(beam)
assembly.update_beam_mesh_with_joints(name, True)
# ---------- end beam ----------
beamcut_plane = GhPythonScript(assembly=beam.assembly, beam_id="b1", plane=plane_normal)  # -> out, assembly_out; inputs plane: Plane
# ---------- beamcut_plane: Python ----------
from integral_timber_joints.geometry import Beam, Beamcut_plane 
from compas_rhino.geometry import RhinoPlane
from compas.geometry import Plane
from copy import deepcopy

assembly_out = deepcopy(assembly)

compas_frame = RhinoPlane.from_geometry(plane).to_compas()
compas_plane = Plane(compas_frame.point, compas_frame.normal)
beam_cut = Beamcut_plane(compas_plane)
print(compas_plane)


assembly_out.set_beam_cut_start(beam_id, beam_cut)
assembly_out.update_beam_mesh_with_joints(assembly_out.sequence[0])
# ---------- end beamcut_plane ----------
basic_assembly_preview = GhPythonScript(assembly=beamcut_plane.assembly_out, beam_ids="b1")  # -> out, beam_mesh_prev; inputs beam_ids: list
# ---------- basic_assembly_preview: Python ----------
from compas_ghpython.helpers import mesh_draw

beam_mesh_prev = []

for beam_id in beam_ids:
    beam = assembly.beam(beam_id)
    beam_mesh_prev.append(mesh_draw(beam.cached_mesh))
# ---------- end basic_assembly_preview ----------
custom_preview = CustomPreview(Geometry=basic_assembly_preview.beam_mesh_prev, Material=ColourSwatch(SwatchColor=RGBA(102, 255, 0, 148)))
