# Grasshopper definition beam_from_brep_algorithm.gh (Grasshopper 1.0.7)

brep = Brep(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)
geo = Geometry(<brep referenced from the Rhino model>)
id = Guid(geo)
debrep = DeconstructBrep(Brep=brep)  # -> Faces, Edges, Vertices
python = GhPythonScript(guid=geo)  # -> out, a
# ---------- python: Python ----------
import rhinoscriptsyntax as rs
import Rhino as rh
import scriptcontext as sc

from compas.geometry import dot_vectors, cross_vectors

print (guid)
brep = rs.coercebrep(guid)

vertices = [[coor for coor in vertex.Location] for vertex in brep.Vertices]
#print (vertices)

face_normals = [[_ for _ in face.NormalAt(face.Domain(0).Mid,face.Domain(1).Mid)] for face in brep.Faces]
#print (face_normals)


points = vertices
vectors = face_normals
bounding_widths = []
for vector in vectors:
    values = [dot_vectors(vector, point) for point in points]
    bounding_widths.append(max(values) - min(values))
    
smallest_bounding_vector = vectors[bounding_widths.index(min(bounding_widths))]
print smallest_bounding_vector
# ---------- end python ----------
evalsrf = EvaluateSurface(Surface=reparameterize(debrep.Faces), Point=Point(0.5, 0.5, 0))  # -> Point, flatten(Normal), UDirection, VDirection, Frame
pt = Point(flatten(debrep.Vertices))

vec = Vector(graft(evalsrf.Normal))
vertices = Vector(pt)
dprod = DotProduct(VectorA=vec, VectorB=vertices, Unitize=False)
sort = SortList(Keys=dprod)  # -> Keys, ValuesA
item = ListItem(List=sort.Keys, Index=0, Wrap=True)
item_2 = ListItem(List=sort.Keys, Index=-1, Wrap=True)
subtraction = Subtraction(A=item_2, B=item)

panel = Panel(evalsrf.Normal)
avr = Average(Input=pt)

sort_2 = SortList(Keys=flatten(subtraction), ValuesA=flatten(vec))  # -> Keys, ValuesA
item_3 = ListItem(List=sort_2.Keys, Index=0, Wrap=True)
item_4 = ListItem(List=sort_2.ValuesA, Index=0, Wrap=True)
amp = Amplitude(Vector=item_4, Amplitude=item_3)

shortest_vector_z = Vector(amp)
vec_2 = Vector(vec)
xprod = CrossProduct(VectorA=shortest_vector_z, VectorB=vec_2, Unitize=False)  # -> flatten(Vector), flatten(Length)
larger = LargerThan(FirstNumber=xprod.Length, SecondNumber=1e-05)  # -> LargerThan, OrEqualTo
cull = CullPattern(List=xprod.Vector, CullPattern=larger.LargerThan)  # -> graft(List)
unit = UnitVector(Vector=cull)

vertices_2 = Vector(pt)
dprod_2 = DotProduct(VectorA=unit, VectorB=vertices_2, Unitize=False)
sort_3 = SortList(Keys=dprod_2)  # -> Keys, ValuesA
item_5 = ListItem(List=sort_3.Keys, Index=-1, Wrap=True)
item_6 = ListItem(List=sort_3.Keys, Index=0, Wrap=True)
subtraction_2 = Subtraction(A=item_5, B=item_6)

sort_4 = SortList(Keys=flatten(subtraction_2), ValuesA=flatten(unit))  # -> Keys, ValuesA
item_7 = ListItem(List=sort_4.Keys, Index=0, Wrap=True)
item_8 = ListItem(List=sort_4.ValuesA, Index=0, Wrap=True)
amp_2 = Amplitude(Vector=item_8, Amplitude=item_7)

pl = ConstructPlane(Origin=avr, XAxis=amp, YAxis=amp_2)
vdis = VectorDisplay(Anchor=avr, Vector=amp_2)
dom = ConstructDomain(DomainStart=expr("-x/2", amp), DomainEnd=expr("x/2", amp))
dom_2 = ConstructDomain(DomainStart=expr("-x/2", amp_2), DomainEnd=expr("x/2", amp_2))
vdis_2 = VectorDisplay(Anchor=avr, Vector=amp)
rectangle = Rectangle(Plane=pl, XSize=dom, YSize=dom_2, Radius=0)  # -> Rectangle, Length
