# Grasshopper definition beam_joints.gh (Grasshopper 1.0.7)

# ----
# Reload Python Modules (if Module Code is Changed)
python_module_to_reload = Panel("""compas
compas_fab
roslibpy
integral_timber_joints""")
# Development Tools
reload = Button()
py = PythonScript(reload_module_button=Toggle(True), module_names=python_module_to_reload)  # inputs module_names: list
# ---------- py: Python ----------
import compas_ghpython
from compas_ghpython import unload_modules
if reload_module_button:
    for module in module_names:
        unload_modules(module)
# ---------- end py ----------

# ----
# Check Path and Environment
compas_version = GhPythonScript()  # -> out, compas_version, compas_fab_version, compas_path, compas_fab_path, compas_env_name, python_directory
# ---------- compas_version: Python ----------
__author__ = "leungp"
__version__ = "2020.04.20"

import rhinoscriptsyntax as rs
import compas
import compas_fab
compas_version  = compas.__version__
compas_fab_version = compas_fab.__version__
import os
compas_path = os.path.abspath(compas.__file__)
compas_fab_path = os.path.abspath(compas_fab.__file__)

import compas_bootstrapper
compas_env_name = compas_bootstrapper.ENVIRONMENT_NAME
python_directory = compas_bootstrapper.PYTHON_DIRECTORY
# ---------- end compas_version ----------
compas_environment_name = Panel(compas_version.compas_env_name)
compas_version_2 = Panel(compas_version.compas_version)
compas_fab_version = Panel(compas_version.compas_fab_version)
compas_path = Panel(compas_version.compas_path)
compas_fab_path = Panel(compas_version.compas_fab_path)
python_directory = Panel(compas_version.python_directory)

panel = Panel("[50.,[[[0.,0.],[0.,0.2],[1.,0.2],[1.,0.],],[[0.,0.],[1.,0.],],[[0.,0.],[0.,0.2],[1.,0.2],[1.,0.],],[[0.,0.],[1.,0.],],]]")
panel_2 = Panel("[50.,[[[0.,0.],[0.2,0.],[0.2,0.2],[0.8,0.2],[0.8,0.],[1.,0.],],[[0.,0.],[0.,0.2],[1.,0.2],[1.,0.],],[[0.,0.],[0.2,0.],[0.2,0.2],[0.8,0.2],[0.8,0.],[1.,0.],],[[0.,0.],[0.,0.2],[1.,0.2],[1.,0.],],]]")
panel_3 = Panel("[50.,[[[0.,0.],[0.038,0.192],[1.,0.],],[[0.,0.],[1.,0.],],[[0.,0.],[0.963,0.193],[1.,0.],],[[0.,0.],[0.193,0.037],[0.808,0.038],[1.,0.],],]]")
panel_4 = Panel("[50.,[[[0.,0.],[1.,0.],],[[0.,0.],[0.5,0.2],[1.,0.],],[[0.,0.],[1.,0.],],[[0.,0.],[0.5,0.2],[1.,0.],],]]")
panel_5 = Panel("[50.,[[[0.,0.],[0.2,0.2],[0.8,0.2],[1.,0.],],[[0.,0.],[1.,0.],],[[0.,0.],[0.2,0.2],[0.8,0.2],[1.,0.],],[[0.,0.],[1.,0.],],]]")
choose_polyline = ValueList({"0", "1", "2", "3", "4"}, selected="4")
merge = Merge(Data1=panel, Data2=panel_2, Data3=panel_3, Data4=panel_4, Data5=panel_5)
item = ListItem(List=merge, Index=choose_polyline, Wrap=True)

# ----
# Auto Create Planar Lap Joints on Intersecting beams
number_slider = Slider(674, range=0..1000)
pt = ConstructPoint(XCoordinate=number_slider, YCoordinate=Slider(500, range=0..1000), ZCoordinate=0)
pt_2 = ConstructPoint(XCoordinate=Slider(100, range=0..1000), YCoordinate=Slider(592, range=0..1000), ZCoordinate=0)
xy = XYPlane(Origin=pt)
prot = RotatePlane(Plane=xy, Angle=degrees(Slider(140, range=-80..180)))
beam = GhPythonScript(
    plane=prot,
    length=Slider(700, range=0..2000),
    width=Slider(100, range=0..100),
    height=Slider(100, range=0..1000),
    name="b2")  # -> out, beam, assembly; inputs plane: Plane
# ---------- beam: Python ----------
from compas_rhino.geometry import RhinoMesh, RhinoPlane

from integral_timber_joints.geometry import Beam
from integral_timber_joints.assembly import Assembly

frame = RhinoPlane.from_geometry(plane).to_compas()

beam = Beam(frame, length, width, height, name)

assembly = Assembly()
assembly.add_beam(beam)
assembly.get_beam_mesh_in_wcf(name, True)
# ---------- end beam ----------
xy_2 = XYPlane(Origin=pt_2)
prot_2 = RotatePlane(Plane=xy_2, Angle=degrees(Slider(0, range=0..100)))
beam_2 = GhPythonScript(
    plane=prot_2,
    length=Slider(800, range=0..3000),
    width=Slider(100, range=0..100),
    height=Slider(100, range=0..1000),
    name="b1")  # -> out, beam, assembly; inputs plane: Plane; same code as beam
jointhalflap = GhPythonScript(beam1=beam_2.beam, beam2=beam.beam, has_screw=Toggle(True))  # -> out, assembly, beam1_negative_mesh, beam2_negative_mesh; inputs has_screw: Boolean
# ---------- jointhalflap: Python ----------
from compas_ghpython import unload_modules
unload_modules('integral_timber_joints')
from compas.datastructures import Mesh
from integral_timber_joints.assembly import Assembly
from integral_timber_joints.geometry import JointHalfLap, Screw_SL
from integral_timber_joints.assembly.beam_assembly_method import BeamAssemblyMethod

assembly = Assembly()
assembly.add_beam(beam1)
assembly.add_beam(beam2)

joint1, joint2, screw_line = JointHalfLap.from_beam_beam_intersection(beam1, beam2)

assembly.add_joint_pair(joint1, joint2, beam1.name, beam2.name)

if has_screw:
    assembly.set_beam_attribute(beam2.name, 'assembly_method', BeamAssemblyMethod.SCREWED_WITH_GRIPPER)

joint_id = beam1.name, beam2.name

assembly.get_beam_mesh_in_wcf(beam1.name, True)
assembly.get_beam_mesh_in_wcf(beam2.name, True)

from compas_ghpython.artists import MeshArtist

shapes = assembly.get_beam_negative_shapes(beam1.name)
beam1_negative_mesh = [MeshArtist(Mesh.from_shape(shape)).draw() for shape in shapes]
shapes = assembly.get_beam_negative_shapes(beam2.name)
beam2_negative_mesh = [MeshArtist(Mesh.from_shape(shape)).draw() for shape in shapes]

print assembly.sequence
screw = assembly.get_screw_of_joint((beam1.name, beam2.name))

print joint1.get_joint_center_at_solid_side(beam1)
print joint2.get_joint_center_at_solid_side(beam2)
print screw.center_line
print joint1.distance
print joint2.distance
# ---------- end jointhalflap ----------
assembly_preview = AssemblyPreview(assembly=jointhalflap.assembly, beam_ids="b2", update_cache=Toggle(True))
assembly_preview_2 = AssemblyPreview(assembly=jointhalflap.assembly, beam_ids="b1", update_cache=Toggle(True))
preview = CustomPreview(Geometry=jointhalflap.beam1_negative_mesh, Material=ColourSwatch(SwatchColor=RGBA(0, 255, 204, 148)))
Z = UnitZ(Factor=120)
move = Move(Geometry=assembly_preview_2, Motion=Z)  # -> Geometry, Transform
preview_2 = CustomPreview(Geometry=assembly_preview_2, Material=ColourSwatch(SwatchColor=RGBA(0, 255, 204, 148)))
preview_3 = CustomPreview(Geometry=assembly_preview, Material=ColourSwatch(SwatchColor=RGBA(0, 255, 204, 148)))

axle_angle = Slider(1, range=-100..100)
out_of_plane_angle = Slider(-18, range=-50..50)
vec = Vector(Vector(-741.7467, -299.68, 0))
line = Line(Line((260.2042598, 1784.319918, 101.8910124), (265.171, 1753.77, 196.982)))
vec_2 = Vector(Vector(4.966740188, -30.54991815, 95.09098764))
rev = Reverse(Vector=vec)
dprod = DotProduct(VectorA=vec_2, VectorB=rev, Unitize=True)
panel_6 = Panel(dprod)

# ----
# Moving Beam
number_slider_2 = Slider(0, range=0..1000)
number_slider_3 = Slider(800, range=0..3000)
number_slider_4 = Slider(100, range=0..100)
number_slider_5 = Slider(100, range=0..200)
pt_3 = ConstructPoint(XCoordinate=number_slider_2, YCoordinate=Slider(1200, range=0..2100), ZCoordinate=0)
xy_3 = XYPlane(Origin=pt_3)
prot_3 = RotatePlane(Plane=xy_3, Angle=degrees(Slider(22, range=0..100)))
beam_3 = GhPythonScript(plane=prot_3, length=number_slider_3, width=number_slider_4, height=number_slider_5, name="b1")  # -> out, beam, assembly; inputs plane: Plane; same code as beam

pln = Plane(prot_3)
deplane = DeconstructPlane(Plane=pln)  # -> Origin, XAxis, YAxis, ZAxis
amp = Amplitude(Vector=deplane.YAxis, Amplitude=expr("x/2", number_slider_5))
amp_2 = Amplitude(Vector=deplane.XAxis, Amplitude=expr("x/2", number_slider_3))
amp_3 = Amplitude(Vector=deplane.ZAxis, Amplitude=expr("x/2", number_slider_4))
addition = Addition(A=amp_2, B=amp, C=amp_3)
move_2 = Move(Geometry=pln, Motion=addition)  # -> Geometry, Transform

# ----
# Stationary Beam
axle_angle_2 = Slider(-21, range=-100..100)
out_of_plane_angle_2 = Slider(-19, range=-50..50)
plane_angle = Slider(74, range=25..155)
downward_offset = Slider(25, range=-20..60)
pln_joint_center = Plane(move_2.Geometry)
deplane_2 = DeconstructPlane(Plane=pln_joint_center)  # -> Origin, XAxis, YAxis, ZAxis
neg = Negative(Value=downward_offset)
rot3d = Rotate3D(Geometry=pln_joint_center, Angle=degrees(axle_angle_2), Center=pln_joint_center, Axis=deplane_2.XAxis)  # -> Geometry, Transform
rot3d_2 = Rotate3D(Geometry=rot3d.Geometry, Angle=degrees(out_of_plane_angle_2), Center=pln_joint_center, Axis=deplane_2.YAxis)  # -> Geometry, Transform
amp_4 = Amplitude(Vector=deplane_2.ZAxis, Amplitude=neg)
rot3d_3 = Rotate3D(Geometry=rot3d_2.Geometry, Angle=degrees(plane_angle), Center=pln_joint_center, Axis=deplane_2.ZAxis)  # -> Geometry, Transform
move_3 = Move(Geometry=rot3d_3.Geometry, Motion=amp_4)  # -> Geometry, Transform
pln_2 = Plane(move_3.Geometry)

number_slider_6 = Slider(800, range=0..3000)
number_slider_7 = Slider(100, range=0..100)
pln_3 = Plane(pln_2)
number_slider_8 = Slider(100, range=0..200)
deplane_3 = DeconstructPlane(Plane=pln_3)  # -> Origin, XAxis, YAxis, ZAxis
amp_5 = Amplitude(Vector=deplane_3.YAxis, Amplitude=expr("x/2", number_slider_8))
amp_6 = Amplitude(Vector=deplane_3.XAxis, Amplitude=expr("x/2", number_slider_6))
amp_7 = Amplitude(Vector=deplane_3.ZAxis, Amplitude=expr("x/2", number_slider_7))
addition_2 = Addition(A=amp_6, B=amp_5, C=amp_7)
rev_2 = Reverse(Vector=addition_2)
move_4 = Move(Geometry=pln_3, Motion=rev_2)  # -> Geometry, Transform
pln_4 = Plane(move_4.Geometry)
beam_4 = GhPythonScript(plane=pln_4, length=number_slider_6, width=number_slider_7, height=number_slider_8, name="b2")  # -> out, beam, assembly; inputs plane: Plane; same code as beam

number_slider_9 = Slider(765, range=0..1000)
number_slider_10 = Slider(1200, range=0..2100)
pt_4 = ConstructPoint(XCoordinate=number_slider_9, YCoordinate=number_slider_10, ZCoordinate=0)
pt_5 = ConstructPoint(XCoordinate=number_slider_9, YCoordinate=number_slider_10, ZCoordinate=Slider(115, range=0..200))
ln = Line(StartPoint=pt_4, EndPoint=pt_5)
screw = GhPythonScript(center_line=ln, head_side_thickness=Slider(48, range=0..100))  # -> out, screw, feature_m_mesh, feature_s_mesh; inputs center_line: Line
# ---------- screw: Python ----------
from compas_ghpython import unload_modules
unload_modules('integral_timber_joints')
from compas_ghpython.artists import MeshArtist
from compas_rhino.geometry import RhinoMesh, RhinoPlane, RhinoLine

from integral_timber_joints.geometry import Screw_SL

center_line = RhinoLine.from_geometry(center_line).to_compas()

screw = Screw_SL.AutoLength_Factory(center_line=center_line, head_side_thickness=head_side_thickness)

feature_m_mesh = [MeshArtist(mesh).draw() for mesh in screw.get_head_side_feature_meshes()]
feature_s_mesh = [MeshArtist(mesh).draw() for mesh in screw.get_thread_side_feature_meshes()]
# ---------- end screw ----------

basic_assembly_preview = GhPythonScript(assembly=beam_3.assembly)  # -> out, beam_mesh_prev; inputs beam_ids: list; disabled
# ---------- basic_assembly_preview: Python ----------
from compas_ghpython.artists import MeshArtist

beam_mesh_prev = []
if beam_ids == []:
    beam_ids = assembly.beam_ids()

for beam_id in beam_ids:
    beam = assembly.beam(beam_id)
    beam_mesh_prev.append(MeshArtist(beam.cached_mesh).draw())
# ---------- end basic_assembly_preview ----------
swatch = ColourSwatch(SwatchColor=RGBA(102, 255, 0, 148))  # disabled
preview_4 = CustomPreview(Geometry=basic_assembly_preview.beam_mesh_prev, Material=swatch)  # disabled

basic_assembly_preview_2 = GhPythonScript(assembly=beam_4.assembly)  # -> out, beam_mesh_prev; inputs beam_ids: list; same code as basic_assembly_preview
preview_5 = CustomPreview(Geometry=basic_assembly_preview_2.beam_mesh_prev, Material=ColourSwatch(SwatchColor=RGBA(255, 157, 0, 148)))

geo = Geometry(screw.feature_s_mesh)

# ----
# Auto Create non-Planar Lap Joints on Intersecting beams
number_slider_11 = Slider(50, range=0..100)
join_2_2_nonplanarlap = GhPythonScript(beam_move=beam_3.beam, beam_stay=beam_4.beam, joint_thickness=number_slider_11, has_screw=Toggle(True))  # -> out, assembly, beam_move_negative_mesh, beam_stay_negative_mesh, test; inputs has_screw: Boolean
# ---------- join_2_2_nonplanarlap: Python ----------
from compas_ghpython import unload_modules
unload_modules('integral_timber_joints')
from compas.datastructures import Mesh
from integral_timber_joints.assembly import Assembly
from integral_timber_joints.geometry import JointNonPlanarLap
from integral_timber_joints.assembly.beam_assembly_method import BeamAssemblyMethod

from compas_ghpython.artists import MeshArtist

from copy import deepcopy
beam_stay = deepcopy(beam_stay)
beam_move = deepcopy(beam_move)


assembly = Assembly()
assembly.add_beam(beam_stay)
assembly.add_beam(beam_move)

joint_s, joint_m, screw_line = JointNonPlanarLap.from_beam_beam_intersection(beam_stay, beam_move, joint_thickness)

assembly.add_joint_pair(joint_m, joint_s, beam_move.name, beam_stay.name)

if has_screw:
    assembly.set_beam_attribute(beam_move.name, 'assembly_method', BeamAssemblyMethod.SCREWED_WITH_GRIPPER)


print (assembly.get_screw_of_joint((beam_move.name, beam_stay.name)))

shapes = assembly.get_beam_negative_shapes(beam_move.name)
beam_move_negative_mesh = [MeshArtist(Mesh.from_shape(shape)).draw() for shape in shapes]
shapes = assembly.get_beam_negative_shapes(beam_stay.name)
beam_stay_negative_mesh = [MeshArtist(Mesh.from_shape(shape)).draw() for shape in shapes]

import Rhino.Geometry as rg
from compas.geometry import Plane, Projection, Point, Line, intersection_line_plane, Vector, cross_vectors, add_vectors
from integral_timber_joints.geometry.utils import mesh_move_vertex_from_neighbor, move_vertex_from_neighbor, polyhedron_box_from_vertices
test = []
def tp(xyz):
    test.append(rg.Point3d(xyz[0], xyz[1], xyz[2]))
    
#tp(joint_s.pt_jc[4])
#tp(joint_s.pt_jc[5])

self = joint_s
# Joint corners alias
pt_c = self.pt_jc

OVERSIZE = max(50.0, self.thickness)

# Project Point [4 to 7] on cheek plane (pt_p)
center_plane = Plane.from_frame(self.center_frame)
P = Projection.from_plane(center_plane)
pt_p = [Point(* pt_c[i+4]).transformed(P) for i in range(4)]

# Intersect Points (pt_x)
corner_lines = [Line(pt_c[i], pt_c[i+4]) for i in range(4)]
pt_x = [intersection_line_plane(line, center_plane) for line in corner_lines]


#tp(pt_c[4])
#tp(pt_p[0])
#tp(pt_p[1])
#tp(pt_c[5])


vertices = []
#vertices.append(pt_c[4])
#vertices.append(pt_p[0])
#vertices.append(pt_p[1])
#vertices.append(pt_c[5])

vertices.append(pt_c[6])
vertices.append(pt_p[2])
vertices.append(pt_p[3])
vertices.append(pt_c[7])


v_hori = Vector.from_start_end(vertices[1], vertices[2])
v_vert = Vector.from_start_end(vertices[0], vertices[1])
normal = v_hori.cross(v_vert).unitized().scaled(100)

move_vertex_from_neighbor(vertices, [0,1,2,3], [1,0,3,2], 100)
vertices.append(add_vectors(vertices[0], normal))
vertices.append(add_vectors(vertices[1], normal))
vertices.append(add_vectors(vertices[2], normal))
vertices.append(add_vectors(vertices[3], normal))

shape = polyhedron_box_from_vertices(vertices)
[tp(p) for p in vertices]

#test = MeshArtist(Mesh.from_shape(shape)).draw()
print (self.axial_dot_product)
no_hook = abs(Vector.from_start_end(pt_c[3], pt_c[7]).unitized().dot(self.center_frame.zaxis) - 1) < 1e-6
print (no_hook)
print (self.center_frame.zaxis)
print (Vector.from_start_end(pt_c[3], pt_c[7]).unitized())
print (Vector.from_start_end(pt_c[2], pt_c[6]).unitized())
print (Vector.from_start_end(pt_c[1], pt_c[5]).unitized())
print (Vector.from_start_end(pt_c[0], pt_c[4]).unitized())
# ---------- end join_2_2_nonplanarlap ----------
geo_2 = Geometry(join_2_2_nonplanarlap.beam_move_negative_mesh)
geo_3 = Geometry(join_2_2_nonplanarlap.beam_stay_negative_mesh)
assembly_preview_3 = AssemblyPreview(assembly=join_2_2_nonplanarlap.assembly, beam_ids="b2", update_cache=Toggle(True))
assembly_preview_4 = AssemblyPreview(assembly=join_2_2_nonplanarlap.assembly, beam_ids="b1", update_cache=Toggle(True))
Z_2 = UnitZ(Factor=120)
move_5 = Move(Geometry=assembly_preview_4, Motion=Z_2)  # -> Geometry, Transform
preview_6 = CustomPreview(Geometry=assembly_preview_3, Material=ColourSwatch(SwatchColor=RGBA(0, 255, 204, 148)))
preview_7 = CustomPreview(Geometry=move_5.Geometry, Material=ColourSwatch(SwatchColor=RGBA(0, 255, 47, 148)))

move_6 = Move(Geometry=geo_2, Motion=Z_2)  # -> Geometry, Transform
mesh = Mesh(geo_3)
facen = FaceNormals(Mesh=mesh)  # -> Centers, Normals
vdis = VectorDisplay(Anchor=facen.Centers, Vector=facen.Normals)

# ----
# Rhino AssemblyArtist Example (will add brep geometry to Rhino Doc directly)
basic_assembly_preview_3 = GhPythonScript(assembly=join_2_2_nonplanarlap.assembly)  # -> out, beam_nurbs; inputs beam_ids: list; disabled
# ---------- basic_assembly_preview_3: Python ----------
from compas_ghpython import unload_modules
unload_modules('integral_timber_joints')
from compas_ghpython.utilities import draw_mesh
import scriptcontext
import Rhino
scriptcontext.doc = Rhino.RhinoDoc.ActiveDoc
beam_nurbs = []

from integral_timber_joints.rhino.assembly_artist import AssemblyNurbsArtist
aa = AssemblyNurbsArtist(assembly)

if not beam_ids:
    beam_ids = assembly.beam_ids()
    
for beam_id in beam_ids:
    nurbs = aa.draw_beam(beam_id)
    beam_nurbs.append(nurbs)
scriptcontext.doc = ghdoc
# ---------- end basic_assembly_preview_3 ----------

# ----
# Lap Joint on just one side
number_slider_12 = Slider(1000, range=0..1000)
xy_4 = XYPlane(Origin=Point(0, 0, 0))
beam_5 = GhPythonScript(plane=xy_4, length=number_slider_12, width=Slider(100, range=0..100), height=Slider(140, range=0..1000), name="b1")  # -> out, beam, assembly; inputs plane: Plane; same code as beam
joint_90lap = GhPythonScript(
    assembly=beam_5.assembly,
    face_id=Slider(1, range=1..4),
    distance=Slider(309, range=0..1000),
    width=Slider(82, range=0..100),
    length=Slider(100, range=0..100),
    height=Slider(24, range=0..100))  # -> out, assembly_out
# ---------- joint_90lap: Python ----------
from integral_timber_joints.geometry import Beam, Joint_90lap
from copy import deepcopy

empty_beam = Beam(None,1,2,3,'b2')
assembly_out = deepcopy(assembly)

assembly_out.add_beam(empty_beam)

joint = Joint_90lap(distance, face_id, length, width, height)
assembly_out.add_one_joint(joint, assembly_out.sequence[0], assembly_out.sequence[1])
assembly_out.get_beam_mesh_in_wcf(assembly_out.sequence[0])
# ---------- end joint_90lap ----------

panel_7 = Panel(beam_5.out)
assembly_preview_5 = AssemblyPreview(assembly=joint_90lap.assembly_out, beam_ids="b1", update_cache=Toggle(True))

preview_8 = CustomPreview(Geometry=assembly_preview_5, Material=ColourSwatch(SwatchColor=RGBA(102, 255, 0, 148)))

pt_6 = ConstructPoint(XCoordinate=Slider(570, range=0..1000), YCoordinate=Slider(1982, range=0..3000), ZCoordinate=0)
xy_5 = XYPlane(Origin=pt_6)
prot_4 = RotatePlane(Plane=xy_5, Angle=degrees(Slider(90, range=-80..180)))
Z_3 = UnitZ(Factor=120)

# ----
# Lap Joint on just one side
number_slider_13 = Slider(1000, range=0..1000)
xy_6 = XYPlane(Origin=Point(0, 200, 0))
beam_6 = GhPythonScript(plane=xy_6, length=number_slider_13, width=Slider(100, range=0..100), height=Slider(100, range=0..1000), name="b1")  # -> out, beam, assembly; inputs plane: Plane; same code as beam
jointhalflap_2 = GhPythonScript(
    assembly=beam_6.assembly,
    face_id=Slider(4, range=1..4),
    angle=Slider(121, range=10..170),
    distance=Slider(245, range=0..1000),
    width=Slider(100, range=0..100),
    length=Slider(43, range=0..100),
    height=Slider(40, range=0..100))  # -> out, assembly_out, joint_mesh
# ---------- jointhalflap_2: Python ----------
from integral_timber_joints.geometry import Beam, JointHalfLap
from copy import deepcopy

from compas_ghpython.artists import MeshArtist

empty_beam = Beam(None,1,2,3,'b2')
assembly_out = deepcopy(assembly)

assembly_out.add_beam(empty_beam)

joint = JointHalfLap(face_id, distance, angle, length, width, height)
assembly_out.add_one_joint(joint, assembly_out.sequence[0], assembly_out.sequence[1])
assembly_out.get_beam_mesh_in_wcf(assembly_out.sequence[0])

joint_mesh = [MeshArtist(mesh).draw() for mesh in joint.get_feature_meshes(assembly_out.beam(assembly_out.sequence[0]))]
# ---------- end jointhalflap_2 ----------
clamp_frame = GhPythonScript(assembly=jointhalflap_2.assembly_out, beam_id="b1")  # -> out, frames, b
# ---------- clamp_frame: Python ----------
frames = []

from compas_ghpython import draw_frame
for joint in assembly.get_joints_of_beam(beam_id):
    for frame in joint.get_clamp_frames(assembly.beam(beam_id)):
        frames.append(draw_frame(frame))
# ---------- end clamp_frame ----------
item_2 = ListItem(List=clamp_frame.frames, Index=0, Wrap=True)

assembly_preview_6 = AssemblyPreview(assembly=jointhalflap_2.assembly_out, beam_ids="b1", update_cache=Toggle(True))

preview_9 = CustomPreview(Geometry=assembly_preview_6, Material=ColourSwatch(SwatchColor=RGBA(102, 255, 0, 148)))

vec_3 = VectorXYZ(XComponent=Slider(0.4, range=0..1), YComponent=Slider(0.5, range=0..1), ZComponent=Slider(0, range=0..1))  # -> Vector, Length
vec_4 = VectorXYZ(XComponent=Slider(0.7, range=0..1), YComponent=Slider(0, range=0..1), ZComponent=Slider(0.1, range=0..1))  # -> Vector, Length

# ----
# Auto Create Planar Lap Joints on Intersecting beams
has_screw = BooleanToggle(False)
test_with_3d_base_plane = BooleanToggle(True)
pt_7 = ConstructPoint(XCoordinate=Slider(100, range=0..1000), YCoordinate=Slider(2000, range=0..3000), ZCoordinate=0)
xy_7 = XYPlane(Origin=pt_7)
prot_5 = RotatePlane(Plane=xy_7, Angle=degrees(Slider(45, range=0..100)))

pl = ConstructPlane(Origin=pt_7, XAxis=vec_4.Vector, YAxis=vec_3.Vector)

# ----
# Simulating Flip Joint
swap_faceid_to_opposite_face = GhPythonScript(assembly=jointhalflap_2.assembly_out)  # -> out, assembly_out
# ---------- swap_faceid_to_opposite_face: Python ----------
from copy import deepcopy

from compas_ghpython.artists import MeshArtist

assembly_out = deepcopy(assembly)
beam_id = assembly_out.sequence[0]
assembly_out.joint((assembly_out.sequence[0], assembly_out.sequence[1])).swap_faceid_to_opposite_face()
assembly_out.get_beam_mesh_in_wcf(beam_id)
# ---------- end swap_faceid_to_opposite_face ----------
Z_4 = UnitZ(Factor=Slider(237, range=0..1000))

assembly_preview_7 = AssemblyPreview(assembly=swap_faceid_to_opposite_face.assembly_out, beam_ids="b1", update_cache=Toggle(True))

move_7 = Move(Geometry=assembly_preview_7, Motion=Z_4)  # -> Geometry, Transform
preview_10 = CustomPreview(Geometry=move_7.Geometry, Material=ColourSwatch(SwatchColor=RGBA(255, 149, 0, 148)))

filter = StreamFilter(Gate=test_with_3d_base_plane, Stream0=xy_7, Stream1=pl)
orient = Orient(Geometry=prot_5, Source=xy_7, Target=filter)  # -> Geometry, Transform
deplane_4 = DeconstructPlane(Plane=pl)  # -> Origin, XAxis, YAxis, ZAxis
amp_8 = Amplitude(Vector=deplane_4.ZAxis, Amplitude=Slider(120, range=0..120))

beam_7 = GhPythonScript(
    plane=orient.Geometry,
    length=Slider(800, range=0..3000),
    width=Slider(100, range=0..100),
    height=Slider(100, range=0..1000),
    name="b1")  # -> out, beam, assembly; inputs plane: Plane; same code as beam
orient_2 = Orient(Geometry=prot_4, Source=xy_7, Target=filter)  # -> Geometry, Transform
beam_8 = GhPythonScript(
    plane=orient_2.Geometry,
    length=Slider(700, range=0..2000),
    width=Slider(100, range=0..100),
    height=Slider(100, range=0..1000),
    name="b2")  # -> out, beam, assembly; inputs plane: Plane; same code as beam
jointpolylinelap = GhPythonScript(beam1=beam_7.beam, beam2=beam_8.beam, has_screw=has_screw, polyline_string=item)  # -> out, assembly, beam1_negative_mesh, beam2_negative_mesh; inputs has_screw: Boolean
# ---------- jointpolylinelap: Python ----------
from compas_ghpython import unload_modules
unload_modules('integral_timber_joints')
from compas.datastructures import Mesh
from integral_timber_joints.assembly import Assembly
from integral_timber_joints.geometry import JointHalfLap, JointPolylineLap
from integral_timber_joints.assembly.beam_assembly_method import BeamAssemblyMethod

assembly = Assembly()
assembly.add_beam(beam1)
assembly.add_beam(beam2)

joint1, joint2, screw_line = JointPolylineLap.from_beam_beam_intersection(beam1, beam2)
if polyline_string is not None and polyline_string != "":
    joint1.set_parameter('param_string', polyline_string)
    joint2.set_parameter('param_string', polyline_string)
assembly.add_joint_pair(joint1, joint2, beam1.name, beam2.name)

if has_screw:
    assembly.set_beam_attribute(beam2.name, 'assembly_method', BeamAssemblyMethod.SCREWED_WITH_GRIPPER)

joint_id = beam1.name, beam2.name

#assembly.get_beam_mesh_in_wcf(beam1.name, True)
#assembly.get_beam_mesh_in_wcf(beam2.name, True)

from compas_ghpython.artists import MeshArtist

shapes = assembly.get_beam_negative_shapes(beam1.name)
beam1_negative_mesh = [MeshArtist(Mesh.from_shape(shape)).draw() for shape in shapes]
shapes = assembly.get_beam_negative_shapes(beam2.name)
beam2_negative_mesh = [MeshArtist(Mesh.from_shape(shape)).draw() for shape in shapes]

print assembly.sequence
#screw = assembly.get_screw_of_joint((beam1.name, beam2.name))

print joint1.get_joint_center_at_solid_side(beam1)
print joint2.get_joint_center_at_solid_side(beam2)
#print screw.center_line
print joint1.distance_at_center
print joint2.distance_at_center
# ---------- end jointpolylinelap ----------
assembly_preview_8 = AssemblyPreview(assembly=jointpolylinelap.assembly, beam_ids="b1", update_cache=Toggle(True))
assembly_preview_9 = AssemblyPreview(assembly=jointpolylinelap.assembly, beam_ids="b2", update_cache=Toggle(True))
move_8 = Move(Geometry=assembly_preview_9, Motion=amp_8)  # -> Geometry, Transform
preview_11 = CustomPreview(Geometry=assembly_preview_8, Material=ColourSwatch(SwatchColor=RGBA(0, 255, 204, 148)))
preview_12 = CustomPreview(Geometry=move_8.Geometry, Material=ColourSwatch(SwatchColor=RGBA(0, 255, 204, 148)))
faceb = FaceBoundaries(Mesh=move_8.Geometry)
boundary = BoundarySurfaces(Edges=faceb)
join = BrepJoin(Breps=boundary)  # -> Breps, Closed

preview_13 = CustomPreview(Geometry=jointpolylinelap.beam1_negative_mesh, Material=ColourSwatch(SwatchColor=RGBA(110, 255, 0, 148)))

# ==== cluster AssemblyPreview
beam_ids = ClusterInput()
update_cache = ClusterInput()
assembly = ClusterInput()
basic_assembly_preview = GhPythonScript(assembly=assembly, beam_ids=beam_ids, update_cache=update_cache)  # -> out, beam_mesh_prev; inputs beam_ids: list
# ---------- basic_assembly_preview: Python ----------
from compas_ghpython.artists import MeshArtist

beam_mesh_prev = []
if beam_ids == []:
    beam_ids = assembly.beam_ids()

for beam_id in beam_ids:
    beam = assembly.beam(beam_id)
    mesh = assembly.get_beam_mesh_in_wcf(beam_id, not update_cache)
    beam_mesh_prev.append(MeshArtist(mesh).draw())
# ---------- end basic_assembly_preview ----------
beam_mesh_prev = ClusterOutput(basic_assembly_preview.beam_mesh_prev)
