# Grasshopper definition joint_polyline_encoder.gh (Grasshopper 1.0.7)

four_curves_bottom_left_top_right = Curve([<curve referenced from the Rhino model> x4])
four_curves_bottom_left_top_right_2 = Curve([<curve referenced from the Rhino model> x4])
four_curves_bottom_left_top_right_3 = Curve([<curve referenced from the Rhino model> x4])
four_curves_bottom_left_top_right_4 = Curve([<curve referenced from the Rhino model> x4])
four_curves_bottom_left_top_right_5 = Curve([<curve referenced from the Rhino model> x4])
four_curves_bottom_left_top_right_6 = Curve([<curve referenced from the Rhino model> x4])
four_curves_bottom_left_top_right_7 = Curve([<curve referenced from the Rhino model> x4])
depth_mm = Slider(50, range=0..100)
encode_polylines_python = GhPythonScript(four_curves=four_curves_bottom_left_top_right_2, depth=depth_mm)  # -> out, encoded_string; inputs four_curves: list of Polyline
# ---------- encode_polylines_python: Python ----------
import Rhino as rc

def close(x,y):
    return abs(x-y) < 1e-6
    
def encode():
    # Check input to be four curves
    if len(four_curves) != 4:
        print ("Error: Number of input curves must be 4")
        return
        
    if not all([hasattr(crv,'ToPolyline') for crv in four_curves]):
        print ("Error: Input Curves cannot be converted to Polyline")
        
#    polylines = [crv.ToPolyline() for crv in four_curves]
    polylines = four_curves
    # Normalize polylines to 0-1 range
    all_x = []
    all_y = []
    for polyline in polylines:
        for point in polyline.Item:
            all_x.append(point.X)
            all_y.append(point.Y)
            if abs(point.Z) > 1e-8:
                print ("Warning: Input curve Z is not zero: %s" % point.Z)
    x_min = min(all_x)
    x_range = max(all_x) -min(all_x)
    y_min = min(all_y)
    y_range = max(all_y) -min(all_y)
    print("Info: Input X Min = %4.2f, Range = %4.2f, Y Min = %4.2f, Range = %4.2f"% (x_min, x_range, y_min, y_range))
    
    normal_polylines = []
    for i, polyline in enumerate(polylines):
        pl = rc.Geometry.Polyline(polyline.Count)
        for point in polyline.Item:
            x = round((point.X - x_min) / x_range, 6)
            y = round((point.Y - y_min) / y_range, 6)
            # Choose U and V coordinate 
            if i == 0:
                pl.Add(rc.Geometry.Point3d(y,x,0))
            elif i == 1:
                pl.Add(rc.Geometry.Point3d(x,1-y,0))
            elif i == 2:
                pl.Add(rc.Geometry.Point3d(1-y,1-x,0))
            elif i == 3:
                pl.Add(rc.Geometry.Point3d(1-x,y,0))
        normal_polylines.append(pl)
    
    # Automatic flip polylines and check their start end
    for i, polyline in enumerate(normal_polylines):
        if polyline.Item[0].X == 1.0:
            polyline.Reverse()
        n = polyline.Count - 1
        if not close(polyline.Item[0].X, 0.0) or not close(polyline.Item[0].Y, 0.0):
            print ("Error: Line %i did not start at corner" % i )
        if not close(polyline.Item[n].X, 1.0) or not close(polyline.Item[n].Y, 0.0):
            print ("Error: Line %i did not end at corner" % i )
#        print("Line %i" % i)
#        for point in polyline.Item:
#            print ("Point U=%1.3f V=%1.3f" % (point.X, point.Y))
            
    string="["
    string += ("%1.3f" % (depth)).rstrip("0")
    string +=",["
    for i, polyline in enumerate(normal_polylines):
        string +="["
        for point in polyline.Item:
            # print ("Point U=%1.3f V=%1.3f" % (point.X, point.Y))
            string += "["
            string += ("%1.3f" % (point.X)).rstrip("0")
            string += ","
            string += ("%1.3f" % (point.Y)).rstrip("0")
            string += "],"
            
        string += "],"
    string += "]]"
    a = eval(string)
    return string
    
encoded_string = encode()
# ---------- end encode_polylines_python ----------
result = Panel(encode_polylines_python.encoded_string)
encode_report = Panel(encode_polylines_python.out)
panel = Panel("[50.,[[[0.,0.],[0.,0.2],[1.,0.2],[1.,0.],],[[0.,0.],[1.,0.],],[[0.,0.],[0.,0.2],[1.,0.2],[1.,0.],],[[0.,0.],[1.,0.],],]]")
panel_2 = Panel("[50.,[[[0.,0.],[0.2,0.],[0.2,0.2],[0.8,0.2],[0.8,0.],[1.,0.],],[[0.,0.],[0.,0.2],[1.,0.2],[1.,0.],],[[0.,0.],[0.2,0.],[0.2,0.2],[0.8,0.2],[0.8,0.],[1.,0.],],[[0.,0.],[0.,0.2],[1.,0.2],[1.,0.],],]]")
panel_3 = Panel("[50.,[[[0.,0.],[0.038,0.192],[1.,0.],],[[0.,0.],[1.,0.],],[[0.,0.],[0.963,0.193],[1.,0.],],[[0.,0.],[0.193,0.037],[0.808,0.038],[1.,0.],],]]")
panel_4 = Panel("[50.,[[[0.,0.],[1.,0.],],[[0.,0.],[0.5,0.2],[1.,0.],],[[0.,0.],[1.,0.],],[[0.,0.],[0.5,0.2],[1.,0.],],]]")
panel_5 = Panel("[50.,[[[0.,0.],[0.2,0.2],[0.8,0.2],[1.,0.],],[[0.,0.],[1.,0.],],[[0.,0.],[0.2,0.2],[0.8,0.2],[1.,0.],],[[0.,0.],[1.,0.],],]]")
