# Grasshopper definition Tools Definition Example.gh (Grasshopper 1.0.7)

# ----
# Cross Lap Ortho Clamp - CL1
# The clamp type. Identifyable id name.
# Mesh Geometry of the parallel gripper. Base Mesh is attached to the robot (e.g. gripper body, spacer, quick changer)
# Geometry of the Left Body (between jaw and base) modeled at closed state, this part opens towards -neg Y direction as the gripper attach clamp to timber.
# Geometry of the Right Body modeled at closed state, this part opens towards +pos Y direction.
# Geometry of the Left Clamp Jaw modeled at closed state, this jaw open towards +pos Z direction.
# Geometry of the Right Clamp Jaw modeled at closed state, this jaw open towards +pos Z direction.
# Gripper (attach clamp to timber) operation distance limit of each jaw.
# Min = Closed Position
# Max = Open Position
# Clamp (joint closure) operation distance limit of each jaw.
# Min = Closed Position
# Max = Open Position
# Tool Coordinate Frame (TCF) where the clamp is attached to the joint, in relation to T0CF
# Position where the robot (T0CF) needs to reach before picking up tool during tool change . (in relation to T0CF)
# Location (frame) where the tool (TCF) is stored (in WCF) during fabrication
# Vector for gripper to approach beam
# Vector for robot to detach the clamp after joint is assembled. (in relation to T0CF)
xy = XYPlane(Origin=Point(0, 0, 0))
geo = Geometry(<brep referenced from the Rhino model>)
geo_2 = Geometry(<brep referenced from the Rhino model>)
geo_3 = Geometry(<brep referenced from the Rhino model>)
min_closed_position_typ_0 = Slider(0, range=0..200)
max_open_position = Slider(20, range=0..200)
min_closed_position_typ_0_2 = Slider(0, range=0..200)
max_open_position_2 = Slider(120, range=0..200)
pt = Point(<point referenced from the Rhino model>)
pt_2 = Point(<point referenced from the Rhino model>)
geo_4 = Geometry(<brep referenced from the Rhino model>)
geo_5 = Geometry(<brep referenced from the Rhino model>)
xy_2 = XYPlane(Origin=pt_2)
xy_3 = XYPlane(Origin=pt)
mesh = Mesh(geo_4)
mesh_2 = Mesh(geo_3)
mesh_3 = Mesh(geo_5)
mesh_4 = Mesh(geo)
mesh_5 = Mesh(geo_2)
vec = Vector("{0,0,-180}")
vec_2 = Vector("{-120,0,-5}")
Z = UnitZ(Factor=Slider(105, range=0..1000))
create_clamp = GhPythonScript(
    type_name="CL1",
    base_mesh=mesh_4,
    l_body_mesh=mesh_5,
    r_body_mesh=mesh,
    l_jaw_mesh=mesh_2,
    r_jaw_mesh=mesh_3,
    gripper_jaw_position_min=min_closed_position_typ_0,
    gripper_jaw_position_max=max_open_position,
    clamp_jaw_position_min=min_closed_position_typ_0_2,
    clamp_jaw_position_max=max_open_position_2,
    tool_coordinate_frame=xy_3,
    tool_pick_up_frame=xy_2,
    tool_storage_frame=xy,
    approach_vector=Z,
    detachretract1_vector=vec_2,
    detachretract2_vector=vec)  # -> out, visual, robot_model; inputs base_mesh: list of Mesh, l_body_mesh: list of Mesh, r_body_mesh: list of Mesh, l_jaw_mesh: list of Mesh, r_jaw_mesh: list of Mesh, tool_coordinate_frame: Plane, tool_pick_up_frame: Plane, tool_storage_frame: Plane, approach_vector: Vector3d, detachretract1_vector: Vector3d, detachretract2_vector: Vector3d
# ---------- create_clamp: Python ----------
#from compas_ghpython import unload_modules
#unload_modules("integral_timber_joints")

from compas.geometry import Frame
from compas_rhino.geometry import RhinoPlane, RhinoMesh, RhinoVector
from integral_timber_joints.tools import Lap90ClampFactory

tool_coordinate_frame = RhinoPlane.from_geometry(tool_coordinate_frame).to_compas()
tool_pick_up_frame = RhinoPlane.from_geometry(tool_pick_up_frame).to_compas()
tool_storage_frame = RhinoPlane.from_geometry(tool_storage_frame).to_compas()
mesh_gripper_base = [RhinoMesh.from_geometry(m).to_compas() for m in base_mesh]
mesh_gripper_jaw_l = [RhinoMesh.from_geometry(m).to_compas() for m in l_body_mesh]
mesh_gripper_jaw_r = [RhinoMesh.from_geometry(m).to_compas() for m in r_body_mesh]
mesh_clamp_jaw_l = [RhinoMesh.from_geometry(m).to_compas() for m in l_jaw_mesh]
mesh_clamp_jaw_r = [RhinoMesh.from_geometry(m).to_compas() for m in r_jaw_mesh]
approach_vector = RhinoVector.from_geometry(approach_vector).to_compas()
detachretract1_vector = RhinoVector.from_geometry(detachretract1_vector).to_compas()
detachretract2_vector = RhinoVector.from_geometry(detachretract2_vector).to_compas()

robot_model = Lap90ClampFactory(
    None,
    type_name,
    gripper_jaw_position_min,
    gripper_jaw_position_max,
    clamp_jaw_position_min,
    clamp_jaw_position_max,
    tool_coordinate_frame = tool_coordinate_frame,
    tool_pick_up_frame = tool_pick_up_frame,
    tool_storage_frame = tool_storage_frame,
    mesh_gripper_base = mesh_gripper_base,
    mesh_gripper_jaw_l = mesh_gripper_jaw_l,
    mesh_gripper_jaw_r = mesh_gripper_jaw_r,
    mesh_clamp_jaw_l = mesh_clamp_jaw_l,
    mesh_clamp_jaw_r = mesh_clamp_jaw_r,
    approach_vector = approach_vector,
    detachretract1_vector = detachretract1_vector,
    detachretract2_vector = detachretract2_vector,
    )
# ---------- end create_clamp ----------

# ----
# Development Tools
# Reload Python Modules (if Module Code is Changed)
python_module_to_reload = Panel("""compas
compas_fab
roslibpy
integral_timber_joints""")
reload = Button()
py = PythonScript(reload_module_button=reload, module_names=python_module_to_reload)  # inputs module_names: list
# ---------- py: Python ----------
import compas_ghpython
from compas_ghpython import unload_modules
if reload_module_button:
    for module in module_names:
        unload_modules(module)
# ---------- end py ----------

# ----
# Check Path and Environment
compas_version = GhPythonScript()  # -> out, compas_version, compas_fab_version, compas_path, compas_fab_path, compas_env_name, python_directory
# ---------- compas_version: Python ----------
__author__ = "leungp"
__version__ = "2020.04.20"

import rhinoscriptsyntax as rs
import compas
import compas_fab
compas_version  = compas.__version__
compas_fab_version = compas_fab.__version__
import os
compas_path = os.path.abspath(compas.__file__)
compas_fab_path = os.path.abspath(compas_fab.__file__)

import compas_bootstrapper
compas_env_name = compas_bootstrapper.ENVIRONMENT_NAME
python_directory = compas_bootstrapper.PYTHON_DIRECTORY
# ---------- end compas_version ----------
compas_environment_name = Panel(compas_version.compas_env_name)
compas_version_2 = Panel(compas_version.compas_version)
compas_fab_version = Panel(compas_version.compas_fab_version)
compas_path = Panel(compas_version.compas_path)
compas_fab_path = Panel(compas_version.compas_fab_path)
python_directory = Panel(compas_version.python_directory)

abs_maximum_mm = Slider(5000, range=0..5000)
abs_maximum_mm_2 = Slider(2500, range=0..5000)
abs_minimum_mm = Slider(800, range=0..5000)
abs_minimum_mm_2 = Slider(500, range=0..5000)
# Length of beam to be picked up
target_mm = Slider(1400, range=0..5000)

# ----
# Parallel Gripper - PG1
# The gripper type. Identifyable id name.
# Mesh Geometry of the parallel gripper. Base Mesh is attached to the robot (e.g. gripper body, spacer, quick changer)
# Geometry of the Left Jaw modeled at closed state, this jaw open towards -neg Y direction.
# Geometry of the Right Jaw modeled at closed state, this jaw open towards +pos Y direction.
# Jaw operation distance limit of each jaw.
# Min = Closed Position
# Max = Open Position
# Tool Coordinate Frame (TCF) where the beam is held, in relation to T0CF
# Position where the robot (T0CF) needs to reach before picking up tool during tool change . (in relation to T0CF)
# Location (frame) where the tool (TCF) is stored (in WCF) during fabrication
# Vector for gripper to approach beam
xy_4 = XYPlane(Origin=Point(0, 0, 0))
geo_6 = Geometry(<mesh referenced from the Rhino model>)
geo_7 = Geometry(<mesh referenced from the Rhino model>)
geo_8 = Geometry(<mesh referenced from the Rhino model>)
max_open_position_3 = Slider(20, range=0..200)
pt_3 = Point(<point referenced from the Rhino model>)
pt_4 = Point(<point referenced from the Rhino model>)
min_closed_position_typ_0_3 = Slider(0, range=0..200)
xy_5 = XYPlane(Origin=pt_3)
xy_6 = XYPlane(Origin=pt_4)
mesh_6 = Mesh(geo_6)
mesh_7 = Mesh(geo_7)
mesh_8 = Mesh(geo_8)
Z_2 = UnitZ(Factor=Slider(105, range=0..1000))
create_parallel_gripper = GhPythonScript(
    type_name="PG1",
    base_mesh=mesh_6,
    l_jaw_mesh=mesh_7,
    r_jaw_mesh=mesh_8,
    gripper_jaw_position_min=min_closed_position_typ_0_3,
    gripper_jaw_position_max=max_open_position_3,
    tool_coordinate_frame=xy_5,
    tool_pick_up_frame=xy_6,
    tool_storage_frame=xy_4,
    approach_vector=Z_2,
    target_beam_length=target_mm,
    beam_length_limit_min=abs_minimum_mm,
    beam_length_limit_max=abs_maximum_mm)  # -> out, robot_model; inputs base_mesh: Mesh, l_jaw_mesh: Mesh, r_jaw_mesh: Mesh, tool_coordinate_frame: Plane, tool_pick_up_frame: Plane, tool_storage_frame: Plane, approach_vector: Vector3d
# ---------- create_parallel_gripper: Python ----------
from compas_ghpython import unload_modules
unload_modules("integral_timber_joints")

from compas.geometry import Frame, Vector, Box
from compas.datastructures import Mesh

from compas_rhino.geometry import RhinoPlane, RhinoMesh, RhinoVector
from integral_timber_joints.tools import ParallelGripperFactory

#from compas_ghpython.helpers import mesh_draw

tool_coordinate_frame = RhinoPlane.from_geometry(tool_coordinate_frame).to_compas()
tool_pick_up_frame = RhinoPlane.from_geometry(tool_pick_up_frame).to_compas()
tool_storage_frame = RhinoPlane.from_geometry(tool_storage_frame).to_compas()
mesh_gripper_base = [RhinoMesh.from_geometry(base_mesh).to_compas()]
mesh_gripper_jaw_l = [RhinoMesh.from_geometry(l_jaw_mesh).to_compas()]
mesh_gripper_jaw_r = [RhinoMesh.from_geometry(r_jaw_mesh).to_compas()]
approach_vector = RhinoVector.from_geometry(approach_vector).to_compas()


robot_model = ParallelGripperFactory(
    None,
    type_name,
    gripper_jaw_position_min,
    gripper_jaw_position_max,
    tool_coordinate_frame = tool_coordinate_frame,
    tool_pick_up_frame = tool_pick_up_frame,
    tool_storage_frame = tool_storage_frame,
    mesh_gripper_base = mesh_gripper_base,
    mesh_gripper_jaw_l = mesh_gripper_jaw_l,
    mesh_gripper_jaw_r = mesh_gripper_jaw_r,
    target_beam_length = target_beam_length,
    beam_length_limit_min = beam_length_limit_min,
    beam_length_limit_max = beam_length_limit_max,
    approach_vector = approach_vector,
    )
# ---------- end create_parallel_gripper ----------

target_mm_2 = Slider(800, range=0..5000)

# ----
# Parallel Gripper - PG2
# The gripper type. Identifyable id name.
# Mesh Geometry of the parallel gripper. Base Mesh is attached to the robot (e.g. gripper body, spacer, quick changer)
# Geometry of the Left Jaw modeled at closed state, this jaw open towards -neg Y direction.
# Geometry of the Right Jaw modeled at closed state, this jaw open towards +pos Y direction.
# Jaw operation distance limit of each jaw.
# Min = Closed Position
# Max = Open Position
# Tool Coordinate Frame (TCF) where the beam is held, in relation to T0CF
# Position where the robot (T0CF) needs to reach before picking up tool during tool change . (in relation to T0CF)
# Length of beam to be picked up
# Location (frame) where the tool (TCF) is stored (in WCF) during fabrication
# Vector for gripper to approach beam
xy_7 = XYPlane(Origin=Point(0, 0, 0))
geo_9 = Geometry(<mesh referenced from the Rhino model>)
geo_10 = Geometry(<mesh referenced from the Rhino model>)
geo_11 = Geometry(<mesh referenced from the Rhino model>)
max_open_position_4 = Slider(20, range=0..200)
pt_5 = Point(<point referenced from the Rhino model>)
pt_6 = Point(<point referenced from the Rhino model>)
min_closed_position_typ_0_4 = Slider(0, range=0..200)
xy_8 = XYPlane(Origin=pt_5)
xy_9 = XYPlane(Origin=pt_6)
mesh_9 = Mesh(geo_9)
mesh_10 = Mesh(geo_10)
mesh_11 = Mesh(geo_11)
Z_3 = UnitZ(Factor=Slider(105, range=0..1000))
create_parallel_gripper_2 = GhPythonScript(
    type_name="PG2",
    base_mesh=mesh_9,
    l_jaw_mesh=mesh_10,
    r_jaw_mesh=mesh_11,
    gripper_jaw_position_min=min_closed_position_typ_0_4,
    gripper_jaw_position_max=max_open_position_4,
    tool_coordinate_frame=xy_8,
    tool_pick_up_frame=xy_9,
    tool_storage_frame=xy_7,
    approach_vector=Z_3,
    target_beam_length=target_mm_2,
    beam_length_limit_min=abs_minimum_mm_2,
    beam_length_limit_max=abs_maximum_mm_2)  # -> out, robot_model; inputs base_mesh: Mesh, l_jaw_mesh: Mesh, r_jaw_mesh: Mesh, tool_coordinate_frame: Plane, tool_pick_up_frame: Plane, tool_storage_frame: Plane, approach_vector: Vector3d; same code as create_parallel_gripper

# ----
# Save
# Save location next to Rhino File
# Fle name = tool_name.json
auto_path = GhPythonScript(tool_name="PG2")  # -> json_path
# ---------- auto_path: Python ----------
from Rhino.RhinoDoc import ActiveDoc
import os
json_path = os.path.split(ActiveDoc.Path)[0] + os.path.sep + tool_name +".json"
pickle_path = os.path.split(ActiveDoc.Path)[0] + os.path.sep + tool_name +".pickle"
# ---------- end auto_path ----------
save = Button()
python = GhPythonScript(tool_model=create_parallel_gripper_2.robot_model, json_path=auto_path, output=save)  # -> out, json_path, a
# ---------- python: Python ----------
if output:
    from compas.utilities import DataDecoder, DataEncoder
    import json
    with open(json_path, 'w') as f:
        json.dump(tool_model, f, cls=DataEncoder, indent=4, sort_keys=True)
# ---------- end python ----------
panel = Panel(python.out)

# ----
# Save
# Save location next to Rhino File
# Fle name = tool_name.json
auto_path_2 = GhPythonScript(tool_name="CL1")  # -> json_path; same code as auto_path
save_2 = Button()
python_2 = GhPythonScript(tool_model=create_clamp.robot_model, json_path=auto_path_2, output=save_2)  # -> out, json_path, a; same code as python
panel_2 = Panel(python_2.out)

# ----
# Test Changing Base Location
number_slider = Slider(0, range=0..300)
pt_7 = ConstructPoint(XCoordinate=number_slider, YCoordinate=Slider(0, range=0..300), ZCoordinate=0)
xy_10 = XYPlane(Origin=pt_7)
xz = XZPlane(Origin=Point(0, 0, 0))
rotate = Rotate(Geometry=xy_10, Angle=degrees(Slider(0, range=0..300)), Plane=xz)  # -> Geometry, Transform

# ----
# Save
# Save location next to Rhino File
# Fle name = tool_name.json
auto_path_3 = GhPythonScript(tool_name="PG1")  # -> json_path; same code as auto_path
save_3 = Button()
python_3 = GhPythonScript(tool_model=create_parallel_gripper.robot_model, json_path=auto_path_3, output=save_3)  # -> out, json_path, a; same code as python

# ----
# Test Motion
# Test Full Stroke Movement
_0_0_to_1_0_relative_position = Slider(0, range=0..1)
_0_0_to_1_0_relative_position_2 = Slider(0, range=0..1)
deepcopy = GhPythonScript(data_in=create_clamp.robot_model)  # -> data_out
# ---------- deepcopy: Python ----------
from copy import deepcopy
data_out = deepcopy(data_in)
# ---------- end deepcopy ----------
set_clamp_state = GhPythonScript(
    robot_model=deepcopy,
    gripper_jaw_position_relative=_0_0_to_1_0_relative_position_2,
    clamp_jaw_position_relative=_0_0_to_1_0_relative_position)  # -> out, robot_model_out
# ---------- set_clamp_state: Python ----------
from integral_timber_joints.ghpython.utilities import rPlane2cFrame
from compas_rhino.geometry import RhinoPlane

# Deep copy should be performed before editing
robot_model_out = robot_model.copy()

# Set State
if hasattr(robot_model_out,"gripper_jaw_limits"):
    limits = robot_model_out.gripper_jaw_limits
    robot_model_out.gripper_jaw_position = gripper_jaw_position_relative * (limits[1]-limits[0]) + limits[0]

if hasattr(robot_model_out,"clamp_jaw_limits"):
    limits = robot_model_out.clamp_jaw_limits
    robot_model_out.clamp_jaw_position = clamp_jaw_position_relative * (limits[1]-limits[0]) + limits[0]
# ---------- end set_clamp_state ----------

# ----
# Test Motion
# Test Full Stroke Movement
_0_0_to_1_0_relative_position_3 = Slider(0, range=0..1)
deepcopy_2 = GhPythonScript(data_in=create_parallel_gripper_2.robot_model)  # -> data_out; same code as deepcopy
set_clamp_state_2 = GhPythonScript(robot_model=deepcopy_2, gripper_jaw_position_relative=_0_0_to_1_0_relative_position_3)  # -> out, robot_model_out; same code as set_clamp_state

panel_3 = Panel(python_3.out)

# ----
# Load Test
load_tool = GhPythonScript(json_path=python.json_path)  # -> out, tool_model
# ---------- load_tool: Python ----------
from compas.utilities import DataDecoder, DataEncoder
import json
with open(json_path, 'r') as f:
    tool_model = json.load(f, cls=DataDecoder)
# ---------- end load_tool ----------
python_4 = GhPythonScript(tool_model=load_tool.tool_model)  # -> out
# ---------- python_4: Python ----------
print ('tool_model type:', type(tool_model))
print ('tool_model:', tool_model)
print ('type_name:', tool_model.type_name)
print ('name:', tool_model.name)
print ("Links: ")
print ([x.name for x in tool_model.links])
print ("Joints: ")
print ([x.name for x in tool_model.joints])

print ('approach_vector type:', type(tool_model.approach_vector))
print ('approach_vector:', (tool_model.approach_vector))
# ---------- end python_4 ----------
panel_4 = Panel(python_4)

# ----
# Load Test
load_tool_2 = GhPythonScript(json_path=python_2.json_path)  # -> out, tool_model; same code as load_tool
python_5 = GhPythonScript(tool_model=load_tool_2.tool_model)  # -> out; same code as python_4
panel_5 = Panel(python_5)

# ----
# Artist
robot_artist = GhPythonScript(tool_model=set_clamp_state_2.robot_model_out)  # -> out, visual; inputs current_frame: Plane
# ---------- robot_artist: Python ----------
from compas_ghpython.artists import RobotModelArtist
from compas_rhino.geometry import RhinoPlane
from compas.geometry import Transformation

# Create a transformation for base location
if current_frame:
    current_cframe = RhinoPlane.from_geometry(current_frame).to_compas()
    tool_model.current_frame = current_cframe

#compas_visual_mesh = tool_model.draw_visual()
#print (compas_visual_mesh)

artist = RobotModelArtist(tool_model)
visual = tool_model.draw_visual(artist)
# ---------- end robot_artist ----------

# ----
# Artist
robot_artist_2 = GhPythonScript(tool_model=set_clamp_state.robot_model_out)  # -> out, visual; inputs current_frame: Plane; same code as robot_artist

# ----
# Load Test
load_tool_3 = GhPythonScript(json_path=python_3.json_path)  # -> out, tool_model; same code as load_tool
python_6 = GhPythonScript(tool_model=load_tool_3.tool_model)  # -> out; same code as python_4
panel_6 = Panel(python_6)

# ----
# Test Motion
# Test Full Stroke Movement
_0_0_to_1_0_relative_position_4 = Slider(0, range=0..1)
deepcopy_3 = GhPythonScript(data_in=load_tool_3.tool_model)  # -> data_out; same code as deepcopy
set_clamp_state_3 = GhPythonScript(robot_model=deepcopy_3, gripper_jaw_position_relative=_0_0_to_1_0_relative_position_4)  # -> out, robot_model_out
# ---------- set_clamp_state_3: Python ----------
from integral_timber_joints.ghpython.utilities import rPlane2cFrame
from compas_rhino.geometry import RhinoPlane

# Deep copy should be performed before this script
robot_model_out = robot_model

# Set State
if hasattr(robot_model_out,"gripper_jaw_limits"):
    limits = robot_model_out.gripper_jaw_limits
    robot_model_out.gripper_jaw_position = gripper_jaw_position_relative * (limits[1]-limits[0]) + limits[0]
    
if hasattr(robot_model_out,"clamp_jaw_limits"):
    limits = robot_model_out.clamp_jaw_limits
    robot_model_out.clamp_jaw_position = clamp_jaw_position_relative * (limits[1]-limits[0]) + limits[0]
# ---------- end set_clamp_state_3 ----------

# ----
# Artist
robot_artist_3 = GhPythonScript(tool_model=set_clamp_state_3.robot_model_out, current_frame=rotate.Geometry)  # -> out, visual; inputs current_frame: Plane; same code as robot_artist

# ----
# Cross Lap Clamp - CL3 / CL3M
# The clamp type. Identifyable id name.
# Mesh Geometry of the parallel gripper. Base Mesh is attached to the robot (e.g. gripper body, spacer, quick changer)
# Geometry of the gripper jaw modeled at closed state. This part opens towards +pos Z direction of TCF (not T0CF).
# Geometry of the clamp jaw modeled at closed state. This part opens towards +pos Z direction of TCF (not T0CF).
# Gripper (attach clamp to timber) operation distance limit of each jaw.
# Min = Closed Position
# Max = Open Position
# Clamp (joint closure) operation distance limit of each jaw.
# Min = Closed Position
# Max = Open Position
# Tool Coordinate Frame (TCF) where the clamp is attached to the joint, in relation to T0CF
# Position where the robot (T0CF) needs to reach before picking up tool during tool change . (in relation to T0CF)
# Location (frame) where the tool (TCF) is stored (in WCF) during fabrication
# Vector for gripper to approach beam (in relation to T0CF)
# Vector for robot to detach the clamp after joint is assembled. (in relation to T0CF)
# Lines where drill holes are.
# Lines should point towards the hole from outside.
frame_curves_named_x_and_y = Curve([<curve referenced from the Rhino model> x3])
frame_curves_named_x_and_y_2 = Curve([<curve referenced from the Rhino model> x3])
frame_curves_named_x_and_y_3 = Curve([<curve referenced from the Rhino model> x3])
min_closed_position_typ_0_5 = Slider(0, range=0..200)
max_open_position_5 = Slider(40, range=0..200)
min_closed_position_typ_0_6 = Slider(100, range=0..200)
max_open_position_6 = Slider(240, range=0..300)
geo_12 = Geometry([<mesh referenced from the Rhino model> x16])
geo_13 = Geometry([<mesh referenced from the Rhino model> x3])
geo_14 = Geometry([<mesh referenced from the Rhino model> x3])
crv = Curve(<curve referenced from the Rhino model>)
crv_2 = Curve([<curve referenced from the Rhino model> x4])
explode = Explode(Curve=crv, Recursive=True)  # -> Segments, Vertices
mesh_12 = Mesh(geo_12)
mesh_13 = Mesh(geo_14)
end = EndPoints(Curve=explode.Segments)  # -> Start, End
frame_from_crv = FrameFromCrv(frame_curves_named_x_and_y=frame_curves_named_x_and_y)
frame_from_crv_2 = FrameFromCrv(frame_curves_named_x_and_y=frame_curves_named_x_and_y_2)
frame_from_crv_3 = FrameFromCrv(frame_curves_named_x_and_y=frame_curves_named_x_and_y_3)
vec2pt = Vector2Pt(PointA=end.Start, PointB=end.End, Unitize=False)  # -> Vector, Length
rev = Reverse(Vector=vec2pt.Vector)
vdis = VectorDisplay(Anchor=end.Start, Vector=vec2pt.Vector)
item = ListItem(List=vec2pt.Vector, Index=0, Wrap=True)  # -> Item, Item1
item_2 = ListItem(List=rev, Index=0, Wrap=True)  # -> Item, Item1
pln = Plane(frame_from_crv)
pln_2 = Plane(frame_from_crv_2)
pln_3 = Plane(frame_from_crv_3)
panel_7 = Panel(vec2pt.Vector)
deplane = DeconstructPlane(Plane=pln)  # -> Origin, XAxis, YAxis, ZAxis
amp = Amplitude(Vector=deplane.ZAxis, Amplitude=expr("-x", min_closed_position_typ_0_6))
move = Move(Geometry=geo_13, Motion=amp)  # -> Geometry, Transform
vec_approach1_vector = Vector(item.Item)
vec_approach2_vector = Vector(item.Item1)
vec_detachretract1_vector = Vector(item_2.Item1)
vec_detachretract2_vector = Vector(item_2.Item)
mesh_compensated_at_position_zero = Mesh(move.Geometry)

# ----
# The clamp type. Identifyable id name.
# Mesh Geometry of the parallel gripper. Base Mesh is attached to the robot (e.g. gripper body, spacer, quick changer)
# Geometry of the gripper jaw modeled at closed state. This part opens towards +pos Z direction of TCF (not T0CF).
# Geometry of the clamp jaw modeled at closed state. This part opens towards +pos Z direction of TCF (not T0CF).
# Gripper (attach clamp to timber) operation distance limit of each jaw.
# Min = Closed Position
# Max = Open Position
# Clamp (joint closure) operation distance limit of each jaw.
# Min = Closed Position
# Max = Open Position
# Tool Coordinate Frame (TCF) where the clamp is attached to the joint, in relation to T0CF
# Position where the robot (T0CF) needs to reach before picking up tool during tool change . (in relation to T0CF)
# Location (frame) where the tool (TCF) is stored (in WCF) during fabrication
# Vector for gripper to approach beam (in relation to T0CF)
# Vector for robot to detach the clamp after joint is assembled. (in relation to T0CF)
# Lines where drill holes are.
# Lines should point towards the hole from outside.
frame_curves_named_x_and_y_4 = Curve([<curve referenced from the Rhino model> x3])
frame_curves_named_x_and_y_5 = Curve([<curve referenced from the Rhino model> x3])
frame_curves_named_x_and_y_6 = Curve([<curve referenced from the Rhino model> x3])
min_closed_position_typ_0_7 = Slider(0, range=0..200)
max_open_position_7 = Slider(40, range=0..200)
min_closed_position_typ_0_8 = Slider(100, range=0..200)
max_open_position_8 = Slider(240, range=0..300)
mesh_14 = Mesh([<mesh referenced from the Rhino model> x16])
mesh_15 = Mesh([<mesh referenced from the Rhino model> x3])
mesh_16 = Mesh([<mesh referenced from the Rhino model> x3])
crv_3 = Curve(<curve referenced from the Rhino model>)
crv_4 = Curve([<curve referenced from the Rhino model> x4])
explode_2 = Explode(Curve=crv_3, Recursive=True)  # -> Segments, Vertices
end_2 = EndPoints(Curve=explode_2.Segments)  # -> Start, End
frame_from_crv_4 = FrameFromCrv(frame_curves_named_x_and_y=frame_curves_named_x_and_y_4)
frame_from_crv_5 = FrameFromCrv(frame_curves_named_x_and_y=frame_curves_named_x_and_y_5)
frame_from_crv_6 = FrameFromCrv(frame_curves_named_x_and_y=frame_curves_named_x_and_y_6)
vec2pt_2 = Vector2Pt(PointA=end_2.Start, PointB=end_2.End, Unitize=False)  # -> Vector, Length
rev_2 = Reverse(Vector=vec2pt_2.Vector)
vdis_2 = VectorDisplay(Anchor=end_2.Start, Vector=vec2pt_2.Vector)
item_3 = ListItem(List=vec2pt_2.Vector, Index=0, Wrap=True)  # -> Item, Item1
item_4 = ListItem(List=rev_2, Index=0, Wrap=True)  # -> Item, Item1
pln_4 = Plane(frame_from_crv_4)
pln_5 = Plane(frame_from_crv_5)
pln_6 = Plane(frame_from_crv_6)
panel_8 = Panel(vec2pt_2.Vector)
deplane_2 = DeconstructPlane(Plane=pln_4)  # -> Origin, XAxis, YAxis, ZAxis
amp_2 = Amplitude(Vector=deplane_2.ZAxis, Amplitude=expr("-x", min_closed_position_typ_0_8))
move_2 = Move(Geometry=mesh_16, Motion=amp_2)  # -> Geometry, Transform
vec_approach1_vector_2 = Vector(item_3.Item)
vec_approach2_vector_2 = Vector(item_3.Item1)
vec_detachretract2_vector_2 = Vector(item_4.Item)
vec_detachretract1_vector_2 = Vector(item_4.Item1)
mesh_compensated_at_position_zero_2 = Mesh(move_2.Geometry)

create_clamp_2 = GhPythonScript(
    type_name="CL3",
    base_mesh=mesh_12,
    gripper_jaw_mesh=mesh_13,
    clamp_jaw_mesh=mesh_compensated_at_position_zero,
    gripper_jaw_position_min=min_closed_position_typ_0_5,
    gripper_jaw_position_max=max_open_position_5,
    clamp_jaw_position_min=min_closed_position_typ_0_6,
    clamp_jaw_position_max=max_open_position_6,
    tool_coordinate_frame=pln,
    tool_pick_up_frame=pln_2,
    tool_storage_frame=pln_3,
    approach1_vector=vec_approach1_vector,
    approach2_vector=vec_approach2_vector,
    detachretract1_vector=vec_detachretract1_vector,
    detachretract2_vector=vec_detachretract2_vector,
    gripper_drill_lines=crv_2)  # -> out, visual, robot_model; inputs base_mesh: list of Mesh, gripper_jaw_mesh: list of Mesh, clamp_jaw_mesh: list of Mesh, tool_coordinate_frame: Plane, tool_pick_up_frame: Plane, tool_storage_frame: Plane, approach1_vector: Vector3d, approach2_vector: Vector3d, detachretract1_vector: Vector3d, detachretract2_vector: Vector3d, gripper_drill_lines: list of Line
# ---------- create_clamp_2: Python ----------
#from compas_ghpython import unload_modules
#unload_modules("integral_timber_joints")

from compas.geometry import Frame, Vector
from compas_rhino.geometry import RhinoPlane, RhinoMesh, RhinoVector, RhinoLine
from integral_timber_joints.tools import CL3Factory

tool_coordinate_frame = RhinoPlane.from_geometry(tool_coordinate_frame).to_compas()
tool_pick_up_frame = RhinoPlane.from_geometry(tool_pick_up_frame).to_compas()
tool_storage_frame = RhinoPlane.from_geometry(tool_storage_frame).to_compas()
base_mesh = [RhinoMesh.from_geometry(m).to_compas() for m in base_mesh]
gripper_jaw_mesh = [RhinoMesh.from_geometry(m).to_compas() for m in gripper_jaw_mesh]
clamp_jaw_mesh = [RhinoMesh.from_geometry(m).to_compas() for m in clamp_jaw_mesh]
approach1_vector = RhinoVector.from_geometry(approach1_vector).to_compas()
approach2_vector = RhinoVector.from_geometry(approach2_vector).to_compas()
detachretract1_vector = RhinoVector.from_geometry(detachretract1_vector).to_compas()
detachretract2_vector = RhinoVector.from_geometry(detachretract2_vector).to_compas()
gripper_drill_lines = [RhinoLine.from_geometry(crv).to_compas() for crv in gripper_drill_lines]
    
robot_model = CL3Factory(
    None,
    type_name,
    gripper_jaw_position_min,
    gripper_jaw_position_max,
    clamp_jaw_position_min,
    clamp_jaw_position_max,
    tool_coordinate_frame = tool_coordinate_frame,
    tool_pick_up_frame = tool_pick_up_frame,
    tool_storage_frame = tool_storage_frame,
    base_mesh = base_mesh,
    gripper_jaw_mesh = gripper_jaw_mesh,
    clamp_jaw_mesh = clamp_jaw_mesh,
    approach1_vector = approach1_vector,
    approach2_vector = approach2_vector,
    detachretract1_vector = detachretract1_vector,
    detachretract2_vector = detachretract2_vector,
    gripper_drill_lines = gripper_drill_lines
    )
# ---------- end create_clamp_2 ----------
create_clamp_3 = GhPythonScript(
    type_name="CL3M",
    base_mesh=mesh_14,
    gripper_jaw_mesh=mesh_15,
    clamp_jaw_mesh=mesh_compensated_at_position_zero_2,
    gripper_jaw_position_min=min_closed_position_typ_0_7,
    gripper_jaw_position_max=max_open_position_7,
    clamp_jaw_position_min=min_closed_position_typ_0_8,
    clamp_jaw_position_max=max_open_position_8,
    tool_coordinate_frame=pln_4,
    tool_pick_up_frame=pln_5,
    tool_storage_frame=pln_6,
    approach1_vector=vec_approach1_vector_2,
    approach2_vector=vec_approach2_vector_2,
    detachretract1_vector=vec_detachretract1_vector_2,
    detachretract2_vector=vec_detachretract2_vector_2,
    gripper_drill_lines=crv_4)  # -> out, visual, robot_model; inputs base_mesh: list of Mesh, gripper_jaw_mesh: list of Mesh, clamp_jaw_mesh: list of Mesh, tool_coordinate_frame: Plane, tool_pick_up_frame: Plane, tool_storage_frame: Plane, approach1_vector: Vector3d, approach2_vector: Vector3d, detachretract1_vector: Vector3d, detachretract2_vector: Vector3d, gripper_drill_lines: list of Line; same code as create_clamp_2

# ----
# Save
# Save location next to Rhino File
# Fle name = tool_name.json
auto_path_4 = GhPythonScript(tool_name="CL3")  # -> json_path; same code as auto_path
save_4 = Button()
python_7 = GhPythonScript(tool_model=create_clamp_2.robot_model, json_path=auto_path_4, output=save_4)  # -> out, json_path; same code as python

# ----
# Save
# Save location next to Rhino File
# Fle name = tool_name.json
auto_path_5 = GhPythonScript(tool_name="CL3M")  # -> json_path; same code as auto_path
save_5 = Button()
python_8 = GhPythonScript(tool_model=create_clamp_3.robot_model, json_path=auto_path_5, output=save_5)  # -> out, json_path; same code as python

# ----
# Load Test
load_tool_4 = GhPythonScript(json_path=python_7.json_path)  # -> out, tool_model; same code as load_tool
python_9 = GhPythonScript(tool_model=load_tool_4.tool_model)  # -> out; same code as python_4
panel_9 = Panel(python_9)

# ----
# Test Motion
# Test Full Stroke Movement
_0_0_to_1_0_relative_position_5 = Slider(1, range=0..1)
_0_0_to_1_0_relative_position_6 = Slider(1, range=0..1)
deepcopy_4 = GhPythonScript(data_in=load_tool_4.tool_model)  # -> data_out; same code as deepcopy
set_clamp_state_4 = GhPythonScript(
    robot_model=deepcopy_4,
    gripper_jaw_position_relative=_0_0_to_1_0_relative_position_6,
    clamp_jaw_position_relative=_0_0_to_1_0_relative_position_5)  # -> out, robot_model_out
# ---------- set_clamp_state_4: Python ----------
from integral_timber_joints.ghpython.utilities import rPlane2cFrame
from compas_rhino.geometry import RhinoPlane

# Deep copy should be performed before editing
robot_model_out = robot_model.copy()

# Set State
if hasattr(robot_model_out,"gripper_jaw_limits"):
    limits = robot_model_out.gripper_jaw_limits
    robot_model_out.gripper_jaw_position = gripper_jaw_position_relative * (limits[1]-limits[0]) + limits[0]

if hasattr(robot_model_out,"clamp_jaw_limits"):
    limits = robot_model_out.clamp_jaw_limits
    print (limits)
    robot_model_out.clamp_jaw_position = clamp_jaw_position_relative * (limits[1]-limits[0]) + limits[0]
# ---------- end set_clamp_state_4 ----------

# ----
# Artist
robot_artist_4 = GhPythonScript(tool_model=set_clamp_state_4.robot_model_out)  # -> out, visual; inputs current_frame: Plane; same code as robot_artist

# ----
# Load Test
load_tool_5 = GhPythonScript(json_path=python_8.json_path)  # -> out, tool_model; same code as load_tool
python_10 = GhPythonScript(tool_model=load_tool_5.tool_model)  # -> out; same code as python_4
panel_10 = Panel(python_10)

# ----
# Test set current_frame_from_tcf
frame_curves_named_x_and_y_7 = Curve([<curve referenced from the Rhino model> x3])
frame_from_crv_7 = FrameFromCrv(frame_curves_named_x_and_y=frame_curves_named_x_and_y_7)
deepcopy_5 = GhPythonScript(data_in=load_tool_5.tool_model)  # -> data_out; same code as deepcopy
set_clamp_state_5 = GhPythonScript(robot_model=deepcopy_5, tcf=frame_from_crv_7)  # -> out, robot_model_out, current_frame; inputs tcf: Plane
# ---------- set_clamp_state_5: Python ----------
from compas_rhino.geometry import RhinoPlane
from compas_ghpython import draw_frame
# Deep copy should be performed before editing
robot_model_out = robot_model.copy()
robot_model_out.set_current_frame_from_tcp(RhinoPlane.from_geometry(tcf).to_compas())
current_frame = draw_frame(robot_model_out.current_frame)
# ---------- end set_clamp_state_5 ----------
robot_artist_5 = GhPythonScript(tool_model=set_clamp_state_5.robot_model_out)  # -> out, visual; inputs current_frame: Plane; same code as robot_artist

# ----
# Test Motion
# Test Full Stroke Movement
_0_0_to_1_0_relative_position_7 = Slider(0, range=0..1)
_0_0_to_1_0_relative_position_8 = Slider(0, range=0..1)
deepcopy_6 = GhPythonScript(data_in=load_tool_5.tool_model)  # -> data_out; same code as deepcopy
set_clamp_state_6 = GhPythonScript(
    robot_model=deepcopy_6,
    gripper_jaw_position_relative=_0_0_to_1_0_relative_position_8,
    clamp_jaw_position_relative=_0_0_to_1_0_relative_position_7)  # -> out, robot_model_out; same code as set_clamp_state_4

# ----
# Artist
robot_artist_6 = GhPythonScript(tool_model=set_clamp_state_6.robot_model_out)  # -> out, visual; inputs current_frame: Plane; same code as robot_artist

# ----
# Cross Lap Clamp - CL3 / CL3M
# The screwdriver type. Identifyable id name.
# Mesh Geometry of the screwdriver gripper. Base Mesh is attached to the robot (e.g. gripper body, spacer, quick changer)
# Geometry of the pin gripper pins and movable body
# Geometry of the screw
# Pin Gripper linear joint Axis
# Gripper (attach clamp to timber) operation distance limit of each jaw.
# Min = Closed Position
# Max = Open Position
# Tool Coordinate Frame (TCF) where the clamp is attached to the joint, in relation to T0CF
# Position where the robot (T0CF) needs to reach before picking up tool during tool change . (in relation to T0CF)
# Location (frame) where the tool (TCF) is stored (in WCF) during fabrication
# Vector for screwdriver to poke into screw hole (in relation to T0CF)
# Vector for robot to place the tool back to storage. (in relation to T0CF)
# Lines where drill holes are.
# Lines should point towards the hole from outside.
panel_11 = Panel("SL1")
geo_15 = Geometry([<mesh referenced from the Rhino model> x9])
geo_16 = Geometry([<mesh referenced from the Rhino model> x2])
geo_17 = Geometry([<mesh referenced from the Rhino model> x2])
geo_18 = Geometry(<mesh referenced from the Rhino model>)
gripper_jaw_l_axis = Curve(<curve referenced from the Rhino model>)
gripper_jaw_l_axis_2 = Curve(<curve referenced from the Rhino model>)
min_closed_position_typ_0_9 = Slider(0, range=0..200)
max_open_position_9 = Slider(47, range=0..200)
frame_curves_named_x_and_y_8 = Curve([<curve referenced from the Rhino model> x3])
frame_curves_named_x_and_y_9 = Curve([<curve referenced from the Rhino model> x3])
frame_curves_named_x_and_y_10 = Curve([<curve referenced from the Rhino model> x3])
gripper_jaw_l_axis_3 = Curve(<curve referenced from the Rhino model>)
crv_5 = Curve(<curve referenced from the Rhino model>)
crv_6 = Curve([<curve referenced from the Rhino model> x2])
mesh_mesh_gripper_jaw_r = Mesh(geo_17)
mesh_mesh_gripper_jaw_l = Mesh(geo_16)
explode_3 = Explode(Curve=crv_5, Recursive=True)  # -> Segments, Vertices
mesh_17 = Mesh(geo_15)
explode_4 = Explode(Curve=gripper_jaw_l_axis_3, Recursive=True)  # -> Segments, Vertices
explode_5 = Explode(Curve=gripper_jaw_l_axis, Recursive=True)  # -> Segments, Vertices
explode_6 = Explode(Curve=gripper_jaw_l_axis_2, Recursive=True)  # -> Segments, Vertices
end_3 = EndPoints(Curve=explode_3.Segments)  # -> Start, End
frame_from_crv_8 = FrameFromCrv(frame_curves_named_x_and_y=frame_curves_named_x_and_y_8)
frame_from_crv_9 = FrameFromCrv(frame_curves_named_x_and_y=frame_curves_named_x_and_y_9)
frame_from_crv_10 = FrameFromCrv(frame_curves_named_x_and_y=frame_curves_named_x_and_y_10)
end_4 = EndPoints(Curve=explode_4.Segments)  # -> Start, End
end_5 = EndPoints(Curve=explode_5.Segments)  # -> Start, End
end_6 = EndPoints(Curve=explode_6.Segments)  # -> Start, End
vec2pt_3 = Vector2Pt(PointA=end_3.Start, PointB=end_3.End, Unitize=False)  # -> Vector, Length
vec2pt_4 = Vector2Pt(PointA=end_4.Start, PointB=end_4.End, Unitize=False)  # -> Vector, Length
vec2pt_5 = Vector2Pt(PointA=end_5.Start, PointB=end_5.End, Unitize=False)  # -> Vector, Length
vec2pt_6 = Vector2Pt(PointA=end_6.Start, PointB=end_6.End, Unitize=False)  # -> Vector, Length
item_5 = ListItem(List=vec2pt_3.Vector, Index=0, Wrap=True)  # -> Item, Item1
vdis_3 = VectorDisplay(Anchor=end_3.Start, Vector=vec2pt_3.Vector)
pln_7 = Plane(frame_from_crv_8)
vdis_4 = VectorDisplay(Anchor=end_4.Start, Vector=vec2pt_4.Vector)
vdis_5 = VectorDisplay(Anchor=end_5.Start, Vector=vec2pt_5.Vector)
vdis_6 = VectorDisplay(Anchor=end_6.Start, Vector=vec2pt_6.Vector)
approach_vector = Vector(vec2pt_4.Vector)
pln_8 = Plane(frame_from_crv_9)
panel_12 = Panel(vec2pt_3.Vector)
gripper_jaw_l_axis_4 = Vector(vec2pt_6.Vector)
pln_9 = Plane(frame_from_crv_10)
gripper_jaw_l_axis_5 = Vector(vec2pt_5.Vector)
rev_3 = Reverse(Vector=approach_vector)
vec_approach1_vector_3 = Vector(item_5.Item)
vec_approach2_vector_3 = Vector(item_5.Item1)

create_clamp_4 = GhPythonScript(
    type_name=panel_11,
    mesh_gripper_base=mesh_17,
    mesh_gripper_jaw_l=mesh_mesh_gripper_jaw_l,
    mesh_gripper_jaw_r=mesh_mesh_gripper_jaw_r,
    mesh_screw=geo_18,
    gripper_jaw_l_axis=gripper_jaw_l_axis_5,
    gripper_jaw_r_axis=gripper_jaw_l_axis_4,
    gripper_jaw_position_min=min_closed_position_typ_0_9,
    gripper_jaw_position_max=max_open_position_9,
    tool_coordinate_frame=pln_7,
    tool_pick_up_frame=pln_8,
    tool_storage_frame=pln_9,
    approach_vector=approach_vector,
    detachretract_vector=rev_3,
    storageapproach1_vector=vec_approach1_vector_3,
    storageapproach2_vector=vec_approach2_vector_3,
    gripper_drill_lines=crv_6)  # -> out, visual, robot_model; inputs mesh_gripper_base: list of Mesh, mesh_gripper_jaw_l: list of Mesh, mesh_gripper_jaw_r: list of Mesh, mesh_screw: list of Mesh, gripper_jaw_l_axis: Vector3d, gripper_jaw_r_axis: Vector3d, tool_coordinate_frame: Plane, tool_pick_up_frame: Plane, tool_storage_frame: Plane, approach_vector: Vector3d, storageapproach1_vector: Vector3d, storageapproach2_vector: Vector3d, gripper_drill_lines: list of Line
# ---------- create_clamp_4: Python ----------
#from compas_ghpython import unload_modules
#unload_modules("integral_timber_joints")

from compas.geometry import Frame, Vector
from compas_rhino.geometry import RhinoPlane, RhinoMesh, RhinoVector, RhinoLine
from integral_timber_joints.tools import SL1ScrewdriverFactory

tool_coordinate_frame = RhinoPlane.from_geometry(tool_coordinate_frame).to_compas()
tool_pick_up_frame = RhinoPlane.from_geometry(tool_pick_up_frame).to_compas()
tool_storage_frame = RhinoPlane.from_geometry(tool_storage_frame).to_compas()
mesh_gripper_base = [RhinoMesh.from_geometry(m).to_compas() for m in mesh_gripper_base]
mesh_gripper_jaw_l = [RhinoMesh.from_geometry(m).to_compas() for m in mesh_gripper_jaw_l]
mesh_gripper_jaw_r = [RhinoMesh.from_geometry(m).to_compas() for m in mesh_gripper_jaw_r]
mesh_screw = [RhinoMesh.from_geometry(m).to_compas() for m in mesh_screw]
gripper_jaw_l_axis = RhinoVector.from_geometry(gripper_jaw_l_axis).to_compas()
gripper_jaw_r_axis = RhinoVector.from_geometry(gripper_jaw_r_axis).to_compas()
approach_vector = RhinoVector.from_geometry(approach_vector).to_compas()
detachretract_vector = RhinoVector.from_geometry(detachretract_vector).to_compas()
storageapproach1_vector = RhinoVector.from_geometry(storageapproach1_vector).to_compas()
storageapproach2_vector = RhinoVector.from_geometry(storageapproach2_vector).to_compas()
gripper_drill_lines = [RhinoLine.from_geometry(crv).to_compas() for crv in gripper_drill_lines]
    
robot_model = SL1ScrewdriverFactory(
    None,
    type_name,
    gripper_jaw_position_min,
    gripper_jaw_position_max,
    tool_coordinate_frame,  # Ref to T0CF (TCF ~= TCP)
    tool_pick_up_frame,     # Ref to T0CF
    tool_storage_frame,     # Ref to WCF
    mesh_gripper_base,
    mesh_gripper_jaw_l,
    mesh_gripper_jaw_r,
    mesh_screw,
    gripper_jaw_l_axis,
    gripper_jaw_r_axis,
    approach_vector,
    detachretract_vector,
    storageapproach1_vector,
    storageapproach2_vector
    )
# ---------- end create_clamp_4 ----------

# ----
# Save
# Save location next to Rhino File
# Fle name = tool_name.json
auto_path_6 = GhPythonScript(tool_name=panel_11)  # -> json_path; same code as auto_path
save_6 = Button()
python_11 = GhPythonScript(tool_model=create_clamp_4.robot_model, json_path=auto_path_6, output=save_6)  # -> out, json_path; same code as python

panel_13 = Panel(python_11.out)

# ----
# Load Test
load_tool_6 = GhPythonScript(json_path=python_11.json_path)  # -> out, tool_model; same code as load_tool
python_12 = GhPythonScript(tool_model=load_tool_6.tool_model)  # -> out; same code as python_4
panel_14 = Panel(python_12)

# ----
# Test Motion
# Test Full Stroke Movement
_0_0_to_1_0_relative_position_9 = Slider(1, range=0..1)
_0_0_to_1_0_relative_position_10 = Slider(0, range=0..1)
deepcopy_7 = GhPythonScript(data_in=load_tool_6.tool_model)  # -> data_out; same code as deepcopy
set_clamp_state_7 = GhPythonScript(
    robot_model=deepcopy_7,
    gripper_jaw_position_relative=_0_0_to_1_0_relative_position_10,
    clamp_jaw_position_relative=_0_0_to_1_0_relative_position_9)  # -> out, robot_model_out
# ---------- set_clamp_state_7: Python ----------
from integral_timber_joints.ghpython.utilities import rPlane2cFrame
from compas_rhino.geometry import RhinoPlane

# Deep copy should be performed before editing
robot_model_out = robot_model.copy()

# Set State
if hasattr(robot_model_out,"gripper_jaw_limits"):
    limits = robot_model_out.gripper_jaw_limits
    print(limits)
    robot_model_out.gripper_jaw_position = gripper_jaw_position_relative * (limits[1]-limits[0]) + limits[0]

if hasattr(robot_model_out,"clamp_jaw_limits"):
    limits = robot_model_out.clamp_jaw_limits
    print (limits)
    robot_model_out.clamp_jaw_position = clamp_jaw_position_relative * (limits[1]-limits[0]) + limits[0]
# ---------- end set_clamp_state_7 ----------

# ----
# Artist
robot_artist_7 = GhPythonScript(tool_model=set_clamp_state_7.robot_model_out)  # -> out, visual; inputs current_frame: Plane; same code as robot_artist

frame_curves_named_x_and_y_11 = Curve([<curve referenced from the Rhino model> x3])
frame_curves_named_x_and_y_12 = Curve([<curve referenced from the Rhino model> x3])
# Position where the tool (T0CF) needs to reach after picking up tool during tool change . (in relation to T0CF)
frame_curves_named_x_and_y_13 = Curve([<curve referenced from the Rhino model> x3])
frame_curves_named_x_and_y_14 = Curve([<curve referenced from the Rhino model> x3])
# Closing Direction of Left Jaw
X = UnitX(Factor=1)
frame_curves_named_x_and_y_15 = Curve([<curve referenced from the Rhino model> x3])
# Position where the tool (T0CF) needs to reach after picking up tool during tool change . (in relation to T0CF)
frame_curves_named_x_and_y_16 = Curve([<curve referenced from the Rhino model> x3])
frame_curves_named_x_and_y_17 = Curve([<curve referenced from the Rhino model> x3])
frame_curves_named_x_and_y_18 = Curve([<curve referenced from the Rhino model> x3])
# Closing Direction of Left Jaw
X_2 = UnitX(Factor=1)

# ----
# ToolChanger - TC1_NoGPS
# Model the tool changer such that the model at the orgin will be attach to the robot flange.
# 
# Tool changer is a subclass of Tool, however only one instance exist in a given Process. Therefor the name and type_name is the same to simplify things.
# Identifyable name for the tool changer
# Mesh Geometry of the parallel gripper. Base Mesh is attached to the robot (e.g. gripper body, spacer, quick changer)
# Tool Coodinate Frame -
# The tool will attach to this point.
panel_15 = Panel("TC1_NoGPS")
mesh_18 = Mesh(<mesh referenced from the Rhino model>)
frame_curves_named_x_and_y_19 = Curve([<curve referenced from the Rhino model> x3])
frame_from_crv_11 = FrameFromCrv(frame_curves_named_x_and_y=frame_curves_named_x_and_y_19)
# Failed when I have multiple meshes
pln_10 = Plane(frame_from_crv_11)
create_toolchanger = GhPythonScript(type_name=panel_15, base_mesh=mesh_18, tool_coordinate_frame=pln_10)  # -> out, robot_model; inputs base_mesh: list of Mesh, tool_coordinate_frame: Plane
# ---------- create_toolchanger: Python ----------
#from compas_ghpython import unload_modules
#unload_modules("integral_timber_joints")

from compas.geometry import Frame, Vector, Box
from compas.datastructures import Mesh

from compas_rhino.geometry import RhinoPlane, RhinoMesh, RhinoVector
from integral_timber_joints.tools import ToolChanger

tool_coordinate_frame = RhinoPlane.from_geometry(tool_coordinate_frame).to_compas()
base_mesh = [RhinoMesh.from_geometry(m).to_compas() for m in base_mesh]

robot_model = ToolChanger(name = type_name,
                          tool_coordinate_frame = tool_coordinate_frame,
                          collision_mesh = base_mesh,
                          type_name = type_name)
# ---------- end create_toolchanger ----------

# ----
# ToolChanger - TC2 (With IGPS Flange)
# Identifyable name for the tool changer
# Mesh Geometry of the parallel gripper. Base Mesh is attached to the robot (e.g. gripper body, spacer, quick changer)
# Tool Coodinate Frame -
# The tool will attach to this point.
panel_16 = Panel("TC2_iGPS")
mesh_19 = Mesh([<mesh referenced from the Rhino model> x8])
frame_curves_named_x_and_y_20 = Curve([<curve referenced from the Rhino model> x3])
frame_from_crv_12 = FrameFromCrv(frame_curves_named_x_and_y=frame_curves_named_x_and_y_20)
pln_11 = Plane(frame_from_crv_12)
create_toolchanger_2 = GhPythonScript(type_name=panel_16, base_mesh=mesh_19, tool_coordinate_frame=pln_11)  # -> out, robot_model; inputs base_mesh: list of Mesh, tool_coordinate_frame: Plane; same code as create_toolchanger

# ----
# ToolChanger - TC4_Camera
# Identifyable name for the tool changer
# Mesh Geometry of the parallel gripper. Base Mesh is attached to the robot (e.g. gripper body, spacer, quick changer)
# Tool Coodinate Frame -
# The tool will attach to this point.
panel_17 = Panel("TC4_Camera")
mesh_20 = Mesh([<mesh referenced from the Rhino model> x4])
frame_curves_named_x_and_y_21 = Curve([<curve referenced from the Rhino model> x3])
frame_from_crv_13 = FrameFromCrv(frame_curves_named_x_and_y=frame_curves_named_x_and_y_21)
pln_12 = Plane(frame_from_crv_13)
create_toolchanger_3 = GhPythonScript(type_name=panel_17, base_mesh=mesh_20, tool_coordinate_frame=pln_12)  # -> out, robot_model; inputs base_mesh: list of Mesh, tool_coordinate_frame: Plane; same code as create_toolchanger

tc3_tool_changer = Data(create_toolchanger_3.robot_model)
deepcopy_8 = GhPythonScript(data_in=tc3_tool_changer)  # -> data_out; same code as deepcopy
set_clamp_state_8 = GhPythonScript(robot_model=deepcopy_8, tcf=set_clamp_state_5.current_frame)  # -> out, robot_model_out, current_frame; inputs tcf: Plane; same code as set_clamp_state_5
robot_artist_8 = GhPythonScript(tool_model=set_clamp_state_8.robot_model_out)  # -> out, visual; inputs current_frame: Plane; same code as robot_artist

# ----
# ToolChanger - TC3_Igus
# Identifyable name for the tool changer
# Mesh Geometry of the parallel gripper. Base Mesh is attached to the robot (e.g. gripper body, spacer, quick changer)
# Tool Coodinate Frame -
# The tool will attach to this point.
panel_18 = Panel("TC3_Igus")
mesh_21 = Mesh([<mesh referenced from the Rhino model> x3])
frame_curves_named_x_and_y_22 = Curve([<curve referenced from the Rhino model> x3])
frame_from_crv_14 = FrameFromCrv(frame_curves_named_x_and_y=frame_curves_named_x_and_y_22)
pln_13 = Plane(frame_from_crv_14)
create_toolchanger_4 = GhPythonScript(type_name=panel_18, base_mesh=mesh_21, tool_coordinate_frame=pln_13)  # -> out, robot_model; inputs base_mesh: list of Mesh, tool_coordinate_frame: Plane; same code as create_toolchanger

frame_from_crv_15 = FrameFromCrv(frame_curves_named_x_and_y=frame_curves_named_x_and_y_11)
frame_from_crv_16 = FrameFromCrv(frame_curves_named_x_and_y=frame_curves_named_x_and_y_12)
frame_from_crv_17 = FrameFromCrv(frame_curves_named_x_and_y=frame_curves_named_x_and_y_13)
frame_from_crv_18 = FrameFromCrv(frame_curves_named_x_and_y=frame_curves_named_x_and_y_14)
frame_from_crv_19 = FrameFromCrv(frame_curves_named_x_and_y=frame_curves_named_x_and_y_15)
frame_from_crv_20 = FrameFromCrv(frame_curves_named_x_and_y=frame_curves_named_x_and_y_16)
frame_from_crv_21 = FrameFromCrv(frame_curves_named_x_and_y=frame_curves_named_x_and_y_18)
frame_from_crv_22 = FrameFromCrv(frame_curves_named_x_and_y=frame_curves_named_x_and_y_17)
rev_4 = Reverse(Vector=X)
pln_14 = Plane(frame_from_crv_15)
pln_15 = Plane(frame_from_crv_16)
pln_16 = Plane(frame_from_crv_17)
pln_17 = Plane(frame_from_crv_18)

# ----
# Parallel Gripper - PG1000
# The gripper type. Identifyable id name.
# Mesh Geometry of the parallel gripper. Base Mesh is attached to the robot (e.g. gripper body, spacer, quick changer)
# Geometry of the Left Jaw modeled at closed state, this jaw open towards -neg Y direction.
# Geometry of the Right Jaw modeled at closed state, this jaw open towards +pos Y direction.
# Jaw operation distance limit of each jaw.
# Min = Closed Position
# Max = Open Position
# Tool Coordinate Frame (TCF) where the beam is held, in relation to T0CF
# Position where the robot (T0CF) needs to reach before picking up tool during tool change . (in relation to T0CF)
# Location (frame) where the tool (TCF) is stored (in WCF) during fabrication
# Length of beam to be picked up
# Vector for gripper to approach beam
number_slider_2 = Slider(105, range=0..1000)
max_open_position_10 = Slider(10, range=0..200)
min_closed_position_typ_0_10 = Slider(0.8, range=0..200)
mesh_22 = Mesh([<mesh referenced from the Rhino model> x11])
mesh_23 = Mesh([<mesh referenced from the Rhino model> x6])
mesh_24 = Mesh([<mesh referenced from the Rhino model> x6])
Z_4 = UnitZ(Factor=number_slider_2)
abs_maximum_mm_3 = Slider(5000, range=0..5000)
abs_minimum_mm_3 = Slider(1000, range=0..5000)
target_mm_3 = Slider(2000, range=0..5000)
create_parallel_gripper_3 = GhPythonScript(
    type_name="PG1000",
    base_meshes=mesh_22,
    l_jaw_meshes=mesh_24,
    r_jaw_meshes=mesh_23,
    gripper_jaw_position_min=min_closed_position_typ_0_10,
    gripper_jaw_position_max=max_open_position_10,
    tool_coordinate_frame=pln_15,
    tool_pick_up_frame=pln_16,
    tool_pick_up_retract_frame=pln_14,
    tool_storage_frame=pln_17,
    approach_vector=Z_4,
    target_beam_length=target_mm_3,
    beam_length_limit_min=abs_minimum_mm_3,
    beam_length_limit_max=abs_maximum_mm_3,
    jaw_vector_l=X,
    jaw_vector_r=rev_4)  # -> out, robot_model; inputs base_meshes: list of Mesh, l_jaw_meshes: list of Mesh, r_jaw_meshes: list of Mesh, tool_coordinate_frame: Plane, tool_pick_up_frame: Plane, tool_pick_up_retract_frame: Plane, tool_storage_frame: Plane, approach_vector: Vector3d
# ---------- create_parallel_gripper_3: Python ----------
from compas_ghpython import unload_modules
unload_modules("integral_timber_joints")

from compas.geometry import Frame, Vector, Box
from compas.datastructures import Mesh

from compas_rhino.geometry import RhinoPlane, RhinoMesh, RhinoVector
from integral_timber_joints.tools import ParallelGripperFactory

#from compas_ghpython.helpers import mesh_draw

tool_coordinate_frame = RhinoPlane.from_geometry(tool_coordinate_frame).to_compas()
tool_pick_up_frame = RhinoPlane.from_geometry(tool_pick_up_frame).to_compas()
tool_pick_up_retract_frame = RhinoPlane.from_geometry(tool_pick_up_retract_frame).to_compas()
tool_storage_frame = RhinoPlane.from_geometry(tool_storage_frame).to_compas()
meshes_gripper_base = [RhinoMesh.from_geometry(m).to_compas() for m in base_meshes]
meshes_gripper_jaw_l = [RhinoMesh.from_geometry(m).to_compas() for m in l_jaw_meshes]
meshes_gripper_jaw_r = [RhinoMesh.from_geometry(m).to_compas() for m in r_jaw_meshes]
approach_vector = RhinoVector.from_geometry(approach_vector).to_compas()


robot_model = ParallelGripperFactory(
    None,
    type_name,
    gripper_jaw_position_min,
    gripper_jaw_position_max,
    tool_coordinate_frame = tool_coordinate_frame,
    tool_pick_up_frame = tool_pick_up_frame,
    tool_storage_frame = tool_storage_frame,
    mesh_gripper_base = meshes_gripper_base,
    mesh_gripper_jaw_l = meshes_gripper_jaw_l,
    mesh_gripper_jaw_r = meshes_gripper_jaw_r,
    target_beam_length = target_beam_length,
    beam_length_limit_min = beam_length_limit_min,
    beam_length_limit_max = beam_length_limit_max,
    approach_vector = approach_vector,
    jaw_vector_l = jaw_vector_l,
    jaw_vector_r = jaw_vector_r,
    )

robot_model.tool_pick_up_retract_frame = tool_pick_up_retract_frame
# ---------- end create_parallel_gripper_3 ----------

pln_18 = Plane(frame_from_crv_21)

# ----
# Parallel Gripper - PG500
# The gripper type. Identifyable id name.
# Mesh Geometry of the parallel gripper. Base Mesh is attached to the robot (e.g. gripper body, spacer, quick changer)
# Geometry of the Left Jaw modeled at closed state, this jaw open towards -neg Y direction.
# Geometry of the Right Jaw modeled at closed state, this jaw open towards +pos Y direction.
# Jaw operation distance limit of each jaw.
# Min = Closed Position
# Max = Open Position
# Tool Coordinate Frame (TCF) where the beam is held, in relation to T0CF
# Position where the robot (T0CF) needs to reach before picking up tool during tool change . (in relation to T0CF)
# Location (frame) where the tool (TCF) is stored (in WCF) during fabrication
# Length of beam to be picked up
# Vector for gripper to approach beam
number_slider_3 = Slider(105, range=0..1000)
max_open_position_11 = Slider(10, range=0..200)
min_closed_position_typ_0_11 = Slider(0.8, range=0..200)
mesh_25 = Mesh([<mesh referenced from the Rhino model> x11])
mesh_26 = Mesh([<mesh referenced from the Rhino model> x6])
mesh_27 = Mesh([<mesh referenced from the Rhino model> x6])
Z_5 = UnitZ(Factor=number_slider_3)
rev_5 = Reverse(Vector=X_2)
pln_19 = Plane(frame_from_crv_19)
pln_20 = Plane(frame_from_crv_20)
pln_21 = Plane(frame_from_crv_22)
abs_maximum_mm_4 = Slider(4000, range=0..5000)
abs_minimum_mm_4 = Slider(500, range=0..5000)
target_mm_4 = Slider(1000, range=0..5000)
create_parallel_gripper_4 = GhPythonScript(
    type_name="PG500",
    base_meshes=mesh_25,
    l_jaw_meshes=mesh_26,
    r_jaw_meshes=mesh_27,
    gripper_jaw_position_min=min_closed_position_typ_0_11,
    gripper_jaw_position_max=max_open_position_11,
    tool_coordinate_frame=pln_19,
    tool_pick_up_frame=pln_20,
    tool_pick_up_retract_frame=pln_18,
    tool_storage_frame=pln_21,
    approach_vector=Z_5,
    target_beam_length=target_mm_4,
    beam_length_limit_min=abs_minimum_mm_4,
    beam_length_limit_max=abs_maximum_mm_4,
    jaw_vector_l=X_2,
    jaw_vector_r=rev_5)  # -> out, robot_model; inputs base_meshes: list of Mesh, l_jaw_meshes: list of Mesh, r_jaw_meshes: list of Mesh, tool_coordinate_frame: Plane, tool_pick_up_frame: Plane, tool_pick_up_retract_frame: Plane, tool_storage_frame: Plane, approach_vector: Vector3d; same code as create_parallel_gripper_3

# ----
# Test Changing Base Location
number_slider_4 = Slider(0, range=0..300)
pt_8 = ConstructPoint(XCoordinate=Slider(0, range=0..300), YCoordinate=number_slider_4, ZCoordinate=0)
xy_11 = XYPlane(Origin=pt_8)
xz_2 = XZPlane(Origin=Point(0, 0, 0))
rotate_2 = Rotate(Geometry=xy_11, Angle=degrees(Slider(0, range=0..300)), Plane=xz_2)  # -> Geometry, Transform

# ----
# Save
# Save location next to Rhino File
# Fle name = tool_name.json
auto_path_7 = GhPythonScript(tool_name=panel_16)  # -> json_path; same code as auto_path
save_7 = Button()
python_13 = GhPythonScript(tool_model=create_toolchanger_2.robot_model, json_path=auto_path_7, output=save_7)  # -> out, json_path, a; same code as python

# ----
# Test Changing Base Location
number_slider_5 = Slider(0, range=0..300)
pt_9 = ConstructPoint(XCoordinate=Slider(0, range=0..300), YCoordinate=number_slider_5, ZCoordinate=0)
xy_12 = XYPlane(Origin=pt_9)
xz_3 = XZPlane(Origin=Point(0, 0, 0))
rotate_3 = Rotate(Geometry=xy_12, Angle=degrees(Slider(0, range=0..300)), Plane=xz_3)  # -> Geometry, Transform

# ----
# Save
# Save location next to Rhino File
# Fle name = tool_name.json
auto_path_8 = GhPythonScript(tool_name=panel_15)  # -> json_path; same code as auto_path
save_8 = Button()
python_14 = GhPythonScript(tool_model=create_toolchanger.robot_model, json_path=auto_path_8, output=save_8)  # -> out, json_path, a; same code as python

# ----
# Test Changing Base Location
number_slider_6 = Slider(0, range=0..300)
pt_10 = ConstructPoint(XCoordinate=Slider(0, range=0..300), YCoordinate=number_slider_6, ZCoordinate=0)
xy_13 = XYPlane(Origin=pt_10)
xz_4 = XZPlane(Origin=Point(0, 0, 0))
rotate_4 = Rotate(Geometry=xy_13, Angle=degrees(Slider(0, range=0..300)), Plane=xz_4)  # -> Geometry, Transform

# ----
# Save
# Save location next to Rhino File
# Fle name = tool_name.json
auto_path_9 = GhPythonScript(tool_name=panel_18)  # -> json_path; same code as auto_path
save_9 = Button()
python_15 = GhPythonScript(tool_model=create_toolchanger_4.robot_model, json_path=auto_path_9, output=save_9)  # -> out, json_path, a; same code as python

# ----
# Save
# Save location next to Rhino File
# Fle name = tool_name.json
auto_path_10 = GhPythonScript(tool_name=panel_17)  # -> json_path; same code as auto_path
save_10 = Button()
python_16 = GhPythonScript(tool_model=create_toolchanger_3.robot_model, json_path=auto_path_10, output=save_10)  # -> out, json_path, a; same code as python

deepcopy_9 = GhPythonScript(data_in=create_toolchanger.robot_model)  # -> data_out; same code as deepcopy
deepcopy_10 = GhPythonScript(data_in=create_toolchanger_4.robot_model)  # -> data_out; same code as deepcopy
deepcopy_11 = GhPythonScript(data_in=create_toolchanger_3.robot_model)  # -> data_out; same code as deepcopy

# ----
# Save
# Save location next to Rhino File
# Fle name = tool_name.json
auto_path_11 = GhPythonScript(tool_name="PG500")  # -> json_path; same code as auto_path
save_11 = Button()
python_17 = GhPythonScript(tool_model=create_parallel_gripper_4.robot_model, json_path=auto_path_11, output=save_11)  # -> out, json_path, a; same code as python

# ----
# Test Motion
# Test Full Stroke Movement
_0_0_to_1_0_relative_position_11 = Slider(1, range=0..1)
deepcopy_12 = GhPythonScript(data_in=create_parallel_gripper_4.robot_model)  # -> data_out; same code as deepcopy
set_clamp_state_9 = GhPythonScript(robot_model=deepcopy_12, gripper_jaw_position_relative=_0_0_to_1_0_relative_position_11)  # -> out, robot_model_out; same code as set_clamp_state_3

deepcopy_13 = GhPythonScript(data_in=create_toolchanger_2.robot_model)  # -> data_out; same code as deepcopy

# ----
# Save
# Save location next to Rhino File
# Fle name = tool_name.json
auto_path_12 = GhPythonScript(tool_name="PG1000")  # -> json_path; same code as auto_path
save_12 = Button()
python_18 = GhPythonScript(tool_model=create_parallel_gripper_3.robot_model, json_path=auto_path_12, output=save_12)  # -> out, json_path, a; same code as python

# ----
# Test Changing Base Location
number_slider_7 = Slider(0, range=0..300)
pt_11 = ConstructPoint(XCoordinate=Slider(300, range=0..300), YCoordinate=number_slider_7, ZCoordinate=0)
xy_14 = XYPlane(Origin=pt_11)
xz_5 = XZPlane(Origin=Point(0, 0, 0))
rotate_5 = Rotate(Geometry=xy_14, Angle=degrees(Slider(47, range=0..300)), Plane=xz_5)  # -> Geometry, Transform

# ----
# Robot Wrist Collision Mesh - ROB_WRIST
# Robot Wrist Collision Mesh
# 
# This is a simple mesh that represent Robot Wrist for quick collision detection during Process Design
# Name for saving file
# Mesh Geometry of the robot wrist.
panel_19 = Panel("ROB_WRIST")
mesh_28 = Mesh([<mesh referenced from the Rhino model> x2])
create_robotwrist = GhPythonScript(name=panel_19, base_mesh=mesh_28)  # -> out, robotwrist; inputs base_mesh: list of Mesh
# ---------- create_robotwrist: Python ----------
from compas.datastructures import Mesh

from compas_rhino.geometry import RhinoMesh
from integral_timber_joints.tools.robot_wrist import RobotWrist

compas_meshes = [RhinoMesh.from_geometry(m).to_compas() for m in base_mesh]

robotwrist = RobotWrist(name, compas_meshes)
# ---------- end create_robotwrist ----------

robot_artist_9 = GhPythonScript(tool_model=deepcopy_13)  # -> out, visual; inputs current_frame: Plane; same code as robot_artist
panel_20 = Panel(python_14.out)
panel_21 = Panel(python_16.out)
panel_22 = Panel(python_15.out)
panel_23 = Panel(python_17.out)
robot_artist_10 = GhPythonScript(tool_model=deepcopy_9, current_frame=rotate_2.Geometry)  # -> out, visual; inputs current_frame: Plane; same code as robot_artist

# ----
# Load Test
load_tool_7 = GhPythonScript(json_path=python_14.json_path)  # -> out, tool_model; same code as load_tool
python_19 = GhPythonScript(tool_model=load_tool_7.tool_model)  # -> out
# ---------- python_19: Python ----------
print ('tool_model type:', type(tool_model))
print ('tool_model:', tool_model)
print ('type_name:', tool_model.type_name)
print ('name:', tool_model.name)
print ("Links: ")
print ([x.name for x in tool_model.links])
print ("Joints: ")
print ([x.name for x in tool_model.joints])
# ---------- end python_19 ----------
panel_24 = Panel(python_19)

# ----
# Load Test
load_tool_8 = GhPythonScript(json_path=python_13.json_path)  # -> out, tool_model; same code as load_tool
python_20 = GhPythonScript(tool_model=create_toolchanger_2.robot_model)  # -> out; same code as python_19
panel_25 = Panel(python_20)

# ----
# Load Test
load_tool_9 = GhPythonScript(json_path=python_15.json_path)  # -> out, tool_model; same code as load_tool
python_21 = GhPythonScript(tool_model=load_tool_9.tool_model)  # -> out; same code as python_19
panel_26 = Panel(python_21)

# ----
# Load Test
load_tool_10 = GhPythonScript(json_path=python_16.json_path)  # -> out, tool_model; same code as load_tool
python_22 = GhPythonScript(tool_model=load_tool_10.tool_model)  # -> out; same code as python_19
panel_27 = Panel(python_22)

panel_28 = Panel(python_18.out)
robot_artist_11 = GhPythonScript(tool_model=deepcopy_10, current_frame=rotate_4.Geometry)  # -> out, visual; inputs current_frame: Plane; same code as robot_artist
robot_artist_12 = GhPythonScript(tool_model=deepcopy_11, current_frame=rotate_3.Geometry)  # -> out, visual; inputs current_frame: Plane; same code as robot_artist

# ----
# Load Test
load_tool_11 = GhPythonScript(json_path=python_17.json_path)  # -> out, tool_model; same code as load_tool
python_23 = GhPythonScript(tool_model=load_tool_11.tool_model)  # -> out
# ---------- python_23: Python ----------
print ('tool_model type:', type(tool_model))
print ('tool_model:', tool_model)
print ('type_name:', tool_model.type_name)
print ('name:', tool_model.name)
print ("Links: ")
print ([x.name for x in tool_model.links])
print ("Joints: ")
print ([x.name for x in tool_model.joints])

print ('approach_vector type:', type(tool_model.approach_vector))
print ('approach_vector:', (tool_model.approach_vector))

print ('target_beam_length:', (tool_model.target_beam_length))
print ('beam_length_limits:', (tool_model.beam_length_limits))
# ---------- end python_23 ----------
panel_29 = Panel(python_23)

# ----
# Artist
robot_artist_13 = GhPythonScript(tool_model=set_clamp_state_9.robot_model_out, current_frame=rotate_5.Geometry)  # -> out, visual; inputs current_frame: Plane; same code as robot_artist

# ----
# Load Test
load_tool_12 = GhPythonScript(json_path=python_18.json_path)  # -> out, tool_model; same code as load_tool
python_24 = GhPythonScript(tool_model=load_tool_12.tool_model)  # -> out; same code as python_23
panel_30 = Panel(python_24)

# ----
# Test Motion
# Test Full Stroke Movement
_0_0_to_1_0_relative_position_12 = Slider(0, range=0..1)
deepcopy_14 = GhPythonScript(data_in=load_tool_12.tool_model)  # -> data_out; same code as deepcopy
set_clamp_state_10 = GhPythonScript(robot_model=deepcopy_14, gripper_jaw_position_relative=_0_0_to_1_0_relative_position_12)  # -> out, robot_model_out; same code as set_clamp_state_3

# ----
# Artist
robot_artist_14 = GhPythonScript(tool_model=set_clamp_state_10.robot_model_out, current_frame=rotate_5.Geometry)  # -> out, visual; inputs current_frame: Plane; same code as robot_artist

# ----
# Save
# Save location next to Rhino File
# Fle name = tool_name.json
auto_path_13 = GhPythonScript(tool_name=panel_19)  # -> json_path; same code as auto_path
save_13 = Button()
python_25 = GhPythonScript(tool_model=create_robotwrist.robotwrist, json_path=auto_path_13, output=save_13)  # -> out, json_path, a; same code as python

panel_31 = Panel(python_25.out)

# ----
# Load Test
load_tool_13 = GhPythonScript(json_path=python_25.json_path)  # -> out, tool_model; same code as load_tool
python_26 = GhPythonScript(tool_model=load_tool_13.tool_model)  # -> out; same code as python_19
panel_32 = Panel(python_26)

# ----
# ToolChanger - TC2 (With IGPS Flange)
# Identifyable name for the tool changer
# Mesh Geometry of the parallel gripper. Base Mesh is attached to the robot (e.g. gripper body, spacer, quick changer)
# Tool Coodinate Frame -
# The tool will attach to this point.
panel_33 = Panel("TC2")
mesh_29 = Mesh([<mesh referenced from the Rhino model> x8])
frame_curves_named_x_and_y_23 = Curve([<curve referenced from the Rhino model> x3])
frame_from_crv_23 = FrameFromCrv(frame_curves_named_x_and_y=frame_curves_named_x_and_y_23)
pln_22 = Plane(frame_from_crv_23)
create_toolchanger_5 = GhPythonScript(type_name=panel_33, base_mesh=mesh_29, tool_coordinate_frame=pln_22)  # -> out, robot_model; inputs base_mesh: list of Mesh, tool_coordinate_frame: Plane; same code as create_toolchanger

robot_artist_15 = GhPythonScript(tool_model=load_tool_13.tool_model)  # -> out, visual; inputs current_frame: Plane; same code as robot_artist
python_27 = GhPythonScript(tool_model=create_toolchanger_5.robot_model)  # -> out
# ---------- python_27: Python ----------
print ('tool_model type:', type(tool_model))
print ('tool_model:', tool_model)
print ('name:', tool_model.name)
print ("Links: ")
print ([x.name for x in tool_model.links])
print ("Joints: ")
print ([x.name for x in tool_model.joints])

link = tool_model.links[0]
visual = link.visual[0]
geo = visual.geometry

print ("visual: ")
print (visual.__dict__)

print ("geometry: ")
print (geo.__dict__)

print ("shape: ")
shape = geo.shape
print (shape.__dict__)
# ---------- end python_27 ----------

# ----
# Save
# Save location next to Rhino File
# Fle name = tool_name.json
auto_path_14 = GhPythonScript(tool_name=panel_33)  # -> json_path; same code as auto_path
save_14 = Button()
python_28 = GhPythonScript(tool_model=create_toolchanger_5.robot_model, json_path=auto_path_14, output=Toggle(True))  # -> out, json_path, a; same code as python

deepcopy_15 = GhPythonScript(data_in=create_toolchanger_5.robot_model)  # -> data_out; same code as deepcopy
robot_artist_16 = GhPythonScript(tool_model=create_toolchanger_5.robot_model)  # -> out, visual; inputs current_frame: Plane; same code as robot_artist

# ----
# Load Test
load_tool_14 = GhPythonScript(json_path=python_28.json_path)  # -> out, tool_model; same code as load_tool
python_29 = GhPythonScript(tool_model=create_toolchanger_5.robot_model)  # -> out; same code as python_19
panel_34 = Panel(python_29)

# ----
# Test set current_frame_from_tcf
frame_curves_named_x_and_y_24 = Curve([<curve referenced from the Rhino model> x3])
frame_from_crv_24 = FrameFromCrv(frame_curves_named_x_and_y=frame_curves_named_x_and_y_24)
deepcopy_16 = GhPythonScript(data_in=set_clamp_state_4.robot_model_out)  # -> data_out; same code as deepcopy

set_clamp_state_11 = GhPythonScript(robot_model=deepcopy_16, tcf=frame_from_crv_24)  # -> out, robot_model_out, current_frame; inputs tcf: Plane; same code as set_clamp_state_5

robot_artist_17 = GhPythonScript(tool_model=set_clamp_state_11.robot_model_out)  # -> out, visual; inputs current_frame: Plane; same code as robot_artist

tc3_tool_changer_2 = Data(create_toolchanger_3.robot_model)
deepcopy_17 = GhPythonScript(data_in=tc3_tool_changer_2)  # -> data_out; same code as deepcopy
set_clamp_state_12 = GhPythonScript(robot_model=deepcopy_17, tcf=set_clamp_state_11.current_frame)  # -> out, robot_model_out, current_frame; inputs tcf: Plane; same code as set_clamp_state_5
robot_artist_18 = GhPythonScript(tool_model=set_clamp_state_12.robot_model_out)  # -> out, visual; inputs current_frame: Plane; same code as robot_artist

# ----
# Test set current_frame_from_tcf
frame_curves_named_x_and_y_25 = Curve([<curve referenced from the Rhino model> x3])
frame_from_crv_25 = FrameFromCrv(frame_curves_named_x_and_y=frame_curves_named_x_and_y_25)
deepcopy_18 = GhPythonScript(data_in=set_clamp_state_7.robot_model_out)  # -> data_out; same code as deepcopy

set_clamp_state_13 = GhPythonScript(robot_model=deepcopy_18, tcf=frame_from_crv_25)  # -> out, robot_model_out, current_frame; inputs tcf: Plane; same code as set_clamp_state_5

robot_artist_19 = GhPythonScript(tool_model=set_clamp_state_13.robot_model_out)  # -> out, visual; inputs current_frame: Plane; same code as robot_artist

tc3_tool_changer_3 = Data(create_toolchanger_3.robot_model)
deepcopy_19 = GhPythonScript(data_in=tc3_tool_changer_3)  # -> data_out; same code as deepcopy
set_clamp_state_14 = GhPythonScript(robot_model=deepcopy_19, tcf=set_clamp_state_13.current_frame)  # -> out, robot_model_out, current_frame; inputs tcf: Plane; same code as set_clamp_state_5
Z_6 = UnitZ(Factor=Slider(0, range=0..30))
robot_artist_20 = GhPythonScript(tool_model=set_clamp_state_14.robot_model_out)  # -> out, visual; inputs current_frame: Plane; same code as robot_artist
move_3 = Move(Geometry=robot_artist_20.visual, Motion=Z_6)  # -> Geometry, Transform

# ==== cluster FrameFromCrv
frame_curves_named_x_and_y = ClusterInput()
frame_curves_named_x_and_y_2 = Curve(frame_curves_named_x_and_y)
filtername = FilterByName(Geometry=frame_curves_named_x_and_y_2, Name="y")
filtername_2 = FilterByName(Geometry=frame_curves_named_x_and_y_2, Name="x")
end = EndPoints(Curve=filtername_2)  # -> Start, End
end_2 = EndPoints(Curve=filtername)  # -> Start, End
pl_3pt = Plane3Pt(PointA=end.Start, PointB=end.End, PointC=end_2.End)
pl = ClusterOutput(pl_3pt)
